# Dynamo graph 001-Refresh-Dashboard.dyn (Dynamo 2.12.0.5650)

# group: PROJECT BASE POINT
code_block = CodeBlock { "pdeInfoBox"; }
byName = FamilyType.ByName(name=code_block)
byFamilyType = FamilyInstance.ByFamilyType(familyType=byName)
code_block_2 = CodeBlock { "ID"; }
getParameterValueByName = Element.GetParameterValueByName(element=byFamilyType, parameterName=code_block_2)
string = StringInput("231012")
eq = getParameterValueByName == string
filterByBoolMask = List.FilterByBoolMask(list=byFamilyType, mask=eq)
flatten = List.Flatten(list=filterByBoolMask.in)
code_block_3 = CodeBlock { "isValue"; }
get_project_origin_basepoint_and = Python()  # "Get Project Origin, BasePoint and SurveyPoint"; IronPython2; unwired: IN[0]
# ---------- get_project_origin_basepoint_and.python (62 lines) ----------
#Alban de Chasteigner 2018
#twitter : @geniusloci_bim
#geniusloci.bim@gmail.com
#https://github.com/albandechasteigner/GeniusLociForDynamo

import clr
import math
clr.AddReference("RevitServices")
import RevitServices 
from RevitServices.Persistence import DocumentManager
uiapp = DocumentManager.Instance.CurrentUIApplication
app = uiapp.Application
version=int(app.VersionNumber)

clr.AddReference("RevitNodes")
import Revit
clr.ImportExtensions(Revit.GeometryConversion)

clr.AddReference("RevitAPI")
import Autodesk
from Autodesk.Revit.DB import *

inputdoc = UnwrapElement(IN[0]) if isinstance(IN[0],list) else [UnwrapElement(IN[0])]

doc = DocumentManager.Instance.CurrentDBDocument

if version < 2021:
	angleUnit = doc.GetUnits().GetFormatOptions(UnitType.UT_Angle).DisplayUnits
else:
	angleUnit = doc.GetUnits().GetFormatOptions(SpecTypeId.Angle).GetUnitTypeId()

outProjBasePt, outProjSurvPt, outProjLoc = [],[],[]

pbp = FilteredElementCollector(doc).OfCategory(BuiltInCategory.OST_ProjectBasePoint).ToElements()
sbp = FilteredElementCollector(doc).OfCategory(BuiltInCategory.OST_SharedBasePoint).ToElements()

if version < 2018:
	projPos = doc.ActiveProjectLocation.get_ProjectPosition(XYZ(0,0,0))
else :
	projPos = doc.ActiveProjectLocation.GetProjectPosition(XYZ(0,0,0))
	
if version > 2019 and inputdoc != None :
	outProjBasePt = [pbp[0].SharedPosition.ToPoint(),abs(360-(round(Autodesk.Revit.DB.UnitUtils.ConvertFromInternalUnits(projPos.Angle,angleUnit),6)))]
	outProjSurvPt = sbp[0].SharedPosition.ToPoint()
else :
	pbpEW = pbp[0].get_Parameter(BuiltInParameter.BASEPOINT_EASTWEST_PARAM).AsDouble()
	pbpNS = pbp[0].get_Parameter(BuiltInParameter.BASEPOINT_NORTHSOUTH_PARAM).AsDouble()
	pbpElev = pbp[0].get_Parameter(BuiltInParameter.BASEPOINT_ELEVATION_PARAM).AsDouble()
	pbpAngle = pbp[0].get_Parameter(BuiltInParameter.BASEPOINT_ANGLETON_PARAM).AsDouble()*180/math.pi    
	outProjBasePt=[(XYZ(pbpEW,pbpNS,pbpElev)).ToPoint(),round(pbpAngle,6)]

	pspEW = sbp[0].get_Parameter(BuiltInParameter.BASEPOINT_EASTWEST_PARAM).AsDouble()
	pspNS = sbp[0].get_Parameter(BuiltInParameter.BASEPOINT_NORTHSOUTH_PARAM).AsDouble()
	pspElev = sbp[0].get_Parameter(BuiltInParameter.BASEPOINT_ELEVATION_PARAM).AsDouble()
	outProjSurvPt = XYZ(pspEW,pspNS,pspElev).ToPoint()
    	
if projPos == None:
	outProjLoc.append("No Project Position at origin point")
else:
	outProjLoc = XYZ(projPos.EastWest,projPos.NorthSouth,0).ToPoint()
	
OUT = outProjLoc, outProjBasePt, outProjSurvPt, doc.ActiveProjectLocation.Name
# ----------------------------------------
code_block_4 = CodeBlock(x=get_project_origin_basepoint_and) { x[1][0]; }
python_script = Python(IN[0]=code_block_4)  # IronPython2
# ---------- python_script.python (1 lines) ----------
OUT = str(IN[0])
# ----------------------------------------
code_block_5 = CodeBlock { "Point("; ", "; ")"; }
split = String.Split(string=python_script, separator0=code_block_5.out0, separator1=code_block_5.out1, separator2=code_block_5.out2)
code_block_6 = CodeBlock(x=split) { x[0]; }
code_block_7 = CodeBlock(x=split) { x[1]; }
code_block_8 = CodeBlock(x=split) { x[2]; }
code_block_9 = CodeBlock(x=code_block_6, y=code_block_7, z=code_block_8)
# ---------- code_block_9.designscript (9 lines) ----------
x
+"
"
+
y
+"
"
+
z;
# ----------------------------------------
setParameterByName = Element.SetParameterByName(element=flatten, parameterName=code_block_3, value=code_block_9)

# group: IMPORTED CAD LINKS IN 3D
code_block_10 = CodeBlock { "pdeInfoBox"; }
byName_2 = FamilyType.ByName(name=code_block_10)
byFamilyType_2 = FamilyInstance.ByFamilyType(familyType=byName_2)
code_block_11 = CodeBlock { "ID"; }
getParameterValueByName_2 = Element.GetParameterValueByName(element=byFamilyType_2, parameterName=code_block_11)
string_2 = StringInput("605848")
eq_2 = getParameterValueByName_2 == string_2
filterByBoolMask_2 = List.FilterByBoolMask(list=byFamilyType_2, mask=eq_2)
flatten_2 = List.Flatten(list=filterByBoolMask_2.in)
code_block_12 = CodeBlock { "isValue"; }
python_script_2 = Python()  # IronPython2; unwired: IN[0]
# ---------- python_script_2.python (45 lines) ----------
#dynre*
#otrleq
#GetAllImportInstancesOfDWGs

import clr

clr.AddReference('ProtoGeometry')
from Autodesk.DesignScript.Geometry import *

#Import the Revit API
clr.AddReference('RevitAPI')
import Autodesk
from Autodesk.Revit.DB import *

#Import DocumentManager and TransactionManager
clr.AddReference('RevitServices')
import RevitServices
from RevitServices.Persistence import DocumentManager
from RevitServices.Transactions import TransactionManager

#Import ToDSType(bool) extensions method
clr.AddReference('RevitNodes')
import Revit
clr.ImportExtensions(Revit.Elements)

#Reference the active Document and application
doc = DocumentManager.Instance.CurrentDBDocument
uiapp = DocumentManager.Instance.CurrentUIApplication
app = uiapp.Application

#Start scripting here:

col = FilteredElementCollector(doc).OfClass(ImportInstance).ToElements()
impinst = []
impname = []

for i in col:
	impinst.append(i)
		
for j in impinst:
	impname.append(j.Category.Name)
			
OUT = impinst, impname

#dynre*
# ----------------------------------------
code_block_13 = CodeBlock(x=python_script_2) { x[0]; }
parameters = Element.Parameters(element=code_block_13)
id = Parameter.Id(parameter=parameters)
code_block_14 = CodeBlock { -1007703; }
contains = List.Contains(list=id@L2, item=code_block_14)
countTrue = List.CountTrue(list=contains)
python_script_3 = Python(IN[0]=countTrue)  # IronPython2; same code as python_script
setParameterByName_2 = Element.SetParameterByName(element=flatten_2, parameterName=code_block_12, value=python_script_3)

# group: COUNT NOT PINNED REVIT LINKS
code_block_15 = CodeBlock { "pdeInfoBox"; }
byName_3 = FamilyType.ByName(name=code_block_15)
byFamilyType_3 = FamilyInstance.ByFamilyType(familyType=byName_3)
code_block_16 = CodeBlock { "ID"; }
getParameterValueByName_3 = Element.GetParameterValueByName(element=byFamilyType_3, parameterName=code_block_16)
string_3 = StringInput("208741")
eq_3 = getParameterValueByName_3 == string_3
filterByBoolMask_3 = List.FilterByBoolMask(list=byFamilyType_3, mask=eq_3)
flatten_3 = List.Flatten(list=filterByBoolMask_3.in)
code_block_17 = CodeBlock { "isValue"; }
code_block_18 = CodeBlock { "OST_RvtLinks"; }
byName_4 = Category.ByName(name=code_block_18)
all_elements_of_category = ElementsOfCategory(Category=byName_4)
isPinned = Element.IsPinned(element=all_elements_of_category)
countFalse = List.CountFalse(list=isPinned)
python_script_4 = Python(IN[0]=countFalse)  # IronPython2; same code as python_script
setParameterByName_3 = Element.SetParameterByName(element=flatten_3, parameterName=code_block_17, value=python_script_4)

# group: PROJECT ROTATION ANGLE
code_block_19 = CodeBlock { "pdeInfoBox"; }
byName_5 = FamilyType.ByName(name=code_block_19)
byFamilyType_4 = FamilyInstance.ByFamilyType(familyType=byName_5)
code_block_20 = CodeBlock { "ID"; }
getParameterValueByName_4 = Element.GetParameterValueByName(element=byFamilyType_4, parameterName=code_block_20)
string_4 = StringInput("888133")
eq_4 = getParameterValueByName_4 == string_4
filterByBoolMask_4 = List.FilterByBoolMask(list=byFamilyType_4, mask=eq_4)
flatten_4 = List.Flatten(list=filterByBoolMask_4.in)
code_block_21 = CodeBlock { "isValue"; }
projectRotation = Coordinates.ProjectRotation()
python_script_5 = Python(IN[0]=projectRotation)  # IronPython2; same code as python_script
setParameterByName_4 = Element.SetParameterByName(element=flatten_4, parameterName=code_block_21, value=python_script_5)

# group: PROJECT ADDRESS
code_block_22 = CodeBlock { "pdeInfoBox"; }
byName_6 = FamilyType.ByName(name=code_block_22)
byFamilyType_5 = FamilyInstance.ByFamilyType(familyType=byName_6)
code_block_23 = CodeBlock { "ID"; }
getParameterValueByName_5 = Element.GetParameterValueByName(element=byFamilyType_5, parameterName=code_block_23)
string_5 = StringInput("757237")
eq_5 = getParameterValueByName_5 == string_5
filterByBoolMask_5 = List.FilterByBoolMask(list=byFamilyType_5, mask=eq_5)
flatten_5 = List.Flatten(list=filterByBoolMask_5.in)
code_block_24 = CodeBlock { "isValue"; }
code_block_25 = CodeBlock { toggle: bool = true; }
code_block_26 = CodeBlock()
# ---------- code_block_26.designscript (2 lines) ----------
/* Use only if you want to query a linked model*/
docOrRevitLinkInstance: var = null;
# ----------------------------------------
python_script_6 = Python(IN[0]=code_block_25, IN[1]=code_block_26)  # IronPython2
# ---------- python_script_6.python (31 lines) ----------
import clr
clr.AddReference("RevitServices")
import RevitServices
from RevitServices.Persistence import DocumentManager

inputdoc = UnwrapElement(IN[1])
if inputdoc == None:
	doc = DocumentManager.Instance.CurrentDBDocument
elif inputdoc.GetType().ToString() == "Autodesk.Revit.DB.RevitLinkInstance":
	doc = inputdoc.GetLinkDocument()
elif inputdoc.GetType().ToString() == "Autodesk.Revit.DB.Document":
	doc = inputdoc
else: doc = None

elementlist = list()
projinfo = doc.ProjectInformation
elementlist.append(projinfo.OrganizationName)
elementlist.append(projinfo.OrganizationDescription)
elementlist.append(projinfo.BuildingName)
# this property seems to be missing in some files - weird...
try:
	elementlist.append(projinfo.Author)
except:
	elementlist.append(None)
elementlist.append(projinfo.IssueDate)
elementlist.append(projinfo.Status)
elementlist.append(projinfo.ClientName)
elementlist.append(projinfo.Address)
elementlist.append(projinfo.Name)
elementlist.append(projinfo.Number)
OUT = elementlist
# ----------------------------------------
code_block_27 = CodeBlock(seq=python_script_6) { seq[0]; seq[1]; seq[2]; seq[3]; seq[4]; seq[5]; seq[6]; seq[7]; seq[8]; seq[9]; }
setParameterByName_5 = Element.SetParameterByName(element=flatten_5, parameterName=code_block_24, value=code_block_27.out7)

# group: PROJECT NAME
code_block_28 = CodeBlock { "pdeInfoBox"; }
byName_7 = FamilyType.ByName(name=code_block_28)
byFamilyType_6 = FamilyInstance.ByFamilyType(familyType=byName_7)
code_block_29 = CodeBlock { "ID"; }
getParameterValueByName_6 = Element.GetParameterValueByName(element=byFamilyType_6, parameterName=code_block_29)
string_6 = StringInput("574276")
eq_6 = getParameterValueByName_6 == string_6
filterByBoolMask_6 = List.FilterByBoolMask(list=byFamilyType_6, mask=eq_6)
flatten_6 = List.Flatten(list=filterByBoolMask_6.in)
code_block_30 = CodeBlock { "isValue"; }
code_block_31 = CodeBlock { toggle: bool = true; }
code_block_32 = CodeBlock()  # same code as code_block_26
python_script_7 = Python(IN[0]=code_block_31, IN[1]=code_block_32)  # IronPython2; same code as python_script_6
code_block_33 = CodeBlock(seq=python_script_7) { seq[0]; seq[1]; seq[2]; seq[3]; seq[4]; seq[5]; seq[6]; seq[7]; seq[8]; seq[9]; }
setParameterByName_6 = Element.SetParameterByName(element=flatten_6, parameterName=code_block_30, value=code_block_33.out8)

# group: CLIENT
code_block_34 = CodeBlock { "pdeInfoBox"; }
byName_8 = FamilyType.ByName(name=code_block_34)
byFamilyType_7 = FamilyInstance.ByFamilyType(familyType=byName_8)
code_block_35 = CodeBlock { "ID"; }
getParameterValueByName_7 = Element.GetParameterValueByName(element=byFamilyType_7, parameterName=code_block_35)
string_7 = StringInput("527442")
eq_7 = getParameterValueByName_7 == string_7
filterByBoolMask_7 = List.FilterByBoolMask(list=byFamilyType_7, mask=eq_7)
flatten_7 = List.Flatten(list=filterByBoolMask_7.in)
code_block_36 = CodeBlock { "isValue"; }
code_block_37 = CodeBlock { toggle: bool = true; }
code_block_38 = CodeBlock()  # same code as code_block_26
python_script_8 = Python(IN[0]=code_block_37, IN[1]=code_block_38)  # IronPython2; same code as python_script_6
code_block_39 = CodeBlock(seq=python_script_8) { seq[0]; seq[1]; seq[2]; seq[3]; seq[4]; seq[5]; seq[6]; seq[7]; seq[8]; seq[9]; }
setParameterByName_7 = Element.SetParameterByName(element=flatten_7, parameterName=code_block_36, value=code_block_39.out6)

# group: COUNT RVT LINKS
code_block_40 = CodeBlock { "pdeInfoBox"; }
byName_9 = FamilyType.ByName(name=code_block_40)
byFamilyType_8 = FamilyInstance.ByFamilyType(familyType=byName_9)
code_block_41 = CodeBlock { "ID"; }
getParameterValueByName_8 = Element.GetParameterValueByName(element=byFamilyType_8, parameterName=code_block_41)
string_8 = StringInput("578952")
eq_8 = getParameterValueByName_8 == string_8
filterByBoolMask_8 = List.FilterByBoolMask(list=byFamilyType_8, mask=eq_8)
flatten_8 = List.Flatten(list=filterByBoolMask_8.in)
code_block_42 = CodeBlock { "isValue"; }
code_block_43 = CodeBlock { "OST_RvtLinks"; }
byName_10 = Category.ByName(name=code_block_43)
all_elements_of_category_2 = ElementsOfCategory(Category=byName_10)
count = List.Count(list=all_elements_of_category_2)
python_script_9 = Python(IN[0]=count)  # IronPython2; same code as python_script
setParameterByName_8 = Element.SetParameterByName(element=flatten_8, parameterName=code_block_42, value=python_script_9)

# group: GET SURVEY POINT
code_block_44 = CodeBlock { "pdeInfoBox"; }
byName_11 = FamilyType.ByName(name=code_block_44)
byFamilyType_9 = FamilyInstance.ByFamilyType(familyType=byName_11)
code_block_45 = CodeBlock { "ID"; }
getParameterValueByName_9 = Element.GetParameterValueByName(element=byFamilyType_9, parameterName=code_block_45)
string_9 = StringInput("704534")
eq_9 = getParameterValueByName_9 == string_9
filterByBoolMask_9 = List.FilterByBoolMask(list=byFamilyType_9, mask=eq_9)
flatten_9 = List.Flatten(list=filterByBoolMask_9.in)
code_block_46 = CodeBlock { "isValue"; }
get_project_origin_basepoint_and_2 = Python()  # "Get Project Origin, BasePoint and SurveyPoint"; IronPython2; unwired: IN[0]; same code as get_project_origin_basepoint_and
code_block_47 = CodeBlock(x=get_project_origin_basepoint_and_2) { x[2]; }
python_script_10 = Python(IN[0]=code_block_47)  # IronPython2; same code as python_script
code_block_48 = CodeBlock { "Point("; ", "; ")"; }
split_2 = String.Split(string=python_script_10, separator0=code_block_48.out0, separator1=code_block_48.out1, separator2=code_block_48.out2)
code_block_49 = CodeBlock(x=split_2) { x[0]; }
code_block_50 = CodeBlock(x=split_2) { x[1]; }
code_block_51 = CodeBlock(x=split_2) { x[2]; }
code_block_52 = CodeBlock(x=code_block_49, y=code_block_50, z=code_block_51)  # same code as code_block_9
setParameterByName_9 = Element.SetParameterByName(element=flatten_9, parameterName=code_block_46, value=code_block_52)

# group: PROJECT NUMBER
code_block_53 = CodeBlock { "pdeInfoBox"; }
byName_12 = FamilyType.ByName(name=code_block_53)
byFamilyType_10 = FamilyInstance.ByFamilyType(familyType=byName_12)
code_block_54 = CodeBlock { "ID"; }
getParameterValueByName_10 = Element.GetParameterValueByName(element=byFamilyType_10, parameterName=code_block_54)
string_10 = StringInput("799111")
eq_10 = getParameterValueByName_10 == string_10
filterByBoolMask_10 = List.FilterByBoolMask(list=byFamilyType_10, mask=eq_10)
flatten_10 = List.Flatten(list=filterByBoolMask_10.in)
code_block_55 = CodeBlock { "isValue"; }
code_block_56 = CodeBlock { toggle: bool = true; }
code_block_57 = CodeBlock()  # same code as code_block_26
python_script_11 = Python(IN[0]=code_block_56, IN[1]=code_block_57)  # IronPython2; same code as python_script_6
code_block_58 = CodeBlock(seq=python_script_11) { seq[0]; seq[1]; seq[2]; seq[3]; seq[4]; seq[5]; seq[6]; seq[7]; seq[8]; seq[9]; }
setParameterByName_10 = Element.SetParameterByName(element=flatten_10, parameterName=code_block_55, value=code_block_58.out9)

# group: COUNT IMPORTED/LINKED CAD FILES
code_block_59 = CodeBlock { "pdeInfoBox"; }
byName_13 = FamilyType.ByName(name=code_block_59)
byFamilyType_11 = FamilyInstance.ByFamilyType(familyType=byName_13)
code_block_60 = CodeBlock { "ID"; }
getParameterValueByName_11 = Element.GetParameterValueByName(element=byFamilyType_11, parameterName=code_block_60)
string_11 = StringInput("378079")
eq_11 = getParameterValueByName_11 == string_11
filterByBoolMask_11 = List.FilterByBoolMask(list=byFamilyType_11, mask=eq_11)
flatten_11 = List.Flatten(list=filterByBoolMask_11.in)
code_block_61 = CodeBlock { "isValue"; }
python_script_12 = Python()  # IronPython2; unwired: IN[0]; same code as python_script_2
code_block_62 = CodeBlock(x=python_script_12) { x[0]; }
count_2 = List.Count(list=code_block_62)
python_script_13 = Python(IN[0]=count_2)  # IronPython2; same code as python_script
setParameterByName_11 = Element.SetParameterByName(element=flatten_11, parameterName=code_block_61, value=python_script_13)

# group: LIST RVT LINKS NAMES
code_block_63 = CodeBlock { "pdeInfoBox"; }
byName_14 = FamilyType.ByName(name=code_block_63)
byFamilyType_12 = FamilyInstance.ByFamilyType(familyType=byName_14)
code_block_64 = CodeBlock { "ID"; }
getParameterValueByName_12 = Element.GetParameterValueByName(element=byFamilyType_12, parameterName=code_block_64)
string_12 = StringInput("371325")
eq_12 = getParameterValueByName_12 == string_12
filterByBoolMask_12 = List.FilterByBoolMask(list=byFamilyType_12, mask=eq_12)
flatten_12 = List.Flatten(list=filterByBoolMask_12.in)
code_block_65 = CodeBlock { "isValue"; }
code_block_66 = CodeBlock()
# ---------- code_block_66.designscript (2 lines) ----------
"
";
# ----------------------------------------
code_block_67 = CodeBlock { "OST_RvtLinks"; }
byName_15 = Category.ByName(name=code_block_67)
all_elements_of_category_3 = ElementsOfCategory(Category=byName_15)
name = Element.Name(element=all_elements_of_category_3)
code_block_68 = CodeBlock { " : "; }
split_3 = String.Split(string=name, separator0=code_block_68)
code_block_69 = CodeBlock { 0; }
getItemAtIndex = List.GetItemAtIndex(list=split_3@L2, index=code_block_69)
join = String.Join(separator=code_block_66, string0=getItemAtIndex)
setParameterByName_12 = Element.SetParameterByName(element=flatten_12, parameterName=code_block_65, value=join)

# group: CURRENT TIME
code_block_70 = CodeBlock { "pdeInfoBox"; }
byName_16 = FamilyType.ByName(name=code_block_70)
byFamilyType_13 = FamilyInstance.ByFamilyType(familyType=byName_16)
code_block_71 = CodeBlock { "ID"; }
getParameterValueByName_13 = Element.GetParameterValueByName(element=byFamilyType_13, parameterName=code_block_71)
string_13 = StringInput("556682")
eq_13 = getParameterValueByName_13 == string_13
filterByBoolMask_13 = List.FilterByBoolMask(list=byFamilyType_13, mask=eq_13)
flatten_13 = List.Flatten(list=filterByBoolMask_13.in)
code_block_72 = CodeBlock { "isValue"; }
python_script_14 = Python()  # IronPython2; unwired: IN[0]
# ---------- python_script_14.python (2 lines) ----------
from datetime import datetime
OUT = datetime.now().strftime('%d.%m.%Y\n%H:%M:%S')
# ----------------------------------------
setParameterByName_13 = Element.SetParameterByName(element=flatten_13, parameterName=code_block_72, value=python_script_14)

# group: COUNT NOT PINNED CAD FILES
code_block_73 = CodeBlock { "pdeInfoBox"; }
byName_17 = FamilyType.ByName(name=code_block_73)
byFamilyType_14 = FamilyInstance.ByFamilyType(familyType=byName_17)
code_block_74 = CodeBlock { "ID"; }
getParameterValueByName_14 = Element.GetParameterValueByName(element=byFamilyType_14, parameterName=code_block_74)
string_14 = StringInput("785456")
eq_14 = getParameterValueByName_14 == string_14
filterByBoolMask_14 = List.FilterByBoolMask(list=byFamilyType_14, mask=eq_14)
flatten_14 = List.Flatten(list=filterByBoolMask_14.in)
code_block_75 = CodeBlock { "isValue"; }
python_script_15 = Python()  # IronPython2; unwired: IN[0]; same code as python_script_2
code_block_76 = CodeBlock(x=python_script_15) { x[0]; }
isPinned_2 = Element.IsPinned(element=code_block_76)
countFalse_2 = List.CountFalse(list=isPinned_2)
python_script_16 = Python(IN[0]=countFalse_2)  # IronPython2; same code as python_script
setParameterByName_14 = Element.SetParameterByName(element=flatten_14, parameterName=code_block_75, value=python_script_16)

# group: PROJEKT-AUSGABEDATUM
code_block_77 = CodeBlock { "pdeInfoBox"; }
byName_18 = FamilyType.ByName(name=code_block_77)
byFamilyType_15 = FamilyInstance.ByFamilyType(familyType=byName_18)
code_block_78 = CodeBlock { "ID"; }
getParameterValueByName_15 = Element.GetParameterValueByName(element=byFamilyType_15, parameterName=code_block_78)
string_15 = StringInput("621694")
eq_15 = getParameterValueByName_15 == string_15
filterByBoolMask_15 = List.FilterByBoolMask(list=byFamilyType_15, mask=eq_15)
flatten_15 = List.Flatten(list=filterByBoolMask_15.in)
code_block_79 = CodeBlock { "isValue"; }
code_block_80 = CodeBlock { toggle: bool = true; }
code_block_81 = CodeBlock()  # same code as code_block_26
python_script_17 = Python(IN[0]=code_block_80, IN[1]=code_block_81)  # IronPython2; same code as python_script_6
code_block_82 = CodeBlock(seq=python_script_17) { seq[0]; seq[1]; seq[2]; seq[3]; seq[4]; seq[5]; seq[6]; seq[7]; seq[8]; seq[9]; }
setParameterByName_15 = Element.SetParameterByName(element=flatten_15, parameterName=code_block_79, value=code_block_82.out4)

# group: PROJEKT-AUSGABEDATUM
code_block_83 = CodeBlock { "pdeInfoBox"; }
byName_19 = FamilyType.ByName(name=code_block_83)
byFamilyType_16 = FamilyInstance.ByFamilyType(familyType=byName_19)
code_block_84 = CodeBlock { "ID"; }
getParameterValueByName_16 = Element.GetParameterValueByName(element=byFamilyType_16, parameterName=code_block_84)
string_16 = StringInput("466608")
eq_16 = getParameterValueByName_16 == string_16
filterByBoolMask_16 = List.FilterByBoolMask(list=byFamilyType_16, mask=eq_16)
flatten_16 = List.Flatten(list=filterByBoolMask_16.in)
code_block_85 = CodeBlock { "isValue"; }
code_block_86 = CodeBlock { toggle: bool = true; }
code_block_87 = CodeBlock()  # same code as code_block_26
python_script_18 = Python(IN[0]=code_block_86, IN[1]=code_block_87)  # IronPython2; same code as python_script_6
code_block_88 = CodeBlock(seq=python_script_18) { seq[0]; seq[1]; seq[2]; seq[3]; seq[4]; seq[5]; seq[6]; seq[7]; seq[8]; seq[9]; }
setParameterByName_16 = Element.SetParameterByName(element=flatten_16, parameterName=code_block_85, value=code_block_88.out3)

# group: PROJEKT-STATUS
code_block_89 = CodeBlock { "pdeInfoBox"; }
byName_20 = FamilyType.ByName(name=code_block_89)
byFamilyType_17 = FamilyInstance.ByFamilyType(familyType=byName_20)
code_block_90 = CodeBlock { "ID"; }
getParameterValueByName_17 = Element.GetParameterValueByName(element=byFamilyType_17, parameterName=code_block_90)
string_17 = StringInput("672273")
eq_17 = getParameterValueByName_17 == string_17
filterByBoolMask_17 = List.FilterByBoolMask(list=byFamilyType_17, mask=eq_17)
flatten_17 = List.Flatten(list=filterByBoolMask_17.in)
code_block_91 = CodeBlock { "isValue"; }
code_block_92 = CodeBlock { toggle: bool = true; }
code_block_93 = CodeBlock()  # same code as code_block_26
python_script_19 = Python(IN[0]=code_block_92, IN[1]=code_block_93)  # IronPython2; same code as python_script_6
code_block_94 = CodeBlock(seq=python_script_19) { seq[0]; seq[1]; seq[2]; seq[3]; seq[4]; seq[5]; seq[6]; seq[7]; seq[8]; seq[9]; }
setParameterByName_17 = Element.SetParameterByName(element=flatten_17, parameterName=code_block_91, value=code_block_94.out5)

# group: UNTERNEHMENSNAME
code_block_95 = CodeBlock { "pdeInfoBox"; }
byName_21 = FamilyType.ByName(name=code_block_95)
byFamilyType_18 = FamilyInstance.ByFamilyType(familyType=byName_21)
code_block_96 = CodeBlock { "ID"; }
getParameterValueByName_18 = Element.GetParameterValueByName(element=byFamilyType_18, parameterName=code_block_96)
string_18 = StringInput("134698")
eq_18 = getParameterValueByName_18 == string_18
filterByBoolMask_18 = List.FilterByBoolMask(list=byFamilyType_18, mask=eq_18)
flatten_18 = List.Flatten(list=filterByBoolMask_18.in)
code_block_97 = CodeBlock { "isValue"; }
code_block_98 = CodeBlock { toggle: bool = true; }
code_block_99 = CodeBlock()  # same code as code_block_26
python_script_20 = Python(IN[0]=code_block_98, IN[1]=code_block_99)  # IronPython2; same code as python_script_6
code_block_100 = CodeBlock(seq=python_script_20) { seq[0]; seq[1]; seq[2]; seq[3]; seq[4]; seq[5]; seq[6]; seq[7]; seq[8]; seq[9]; }
setParameterByName_18 = Element.SetParameterByName(element=flatten_18, parameterName=code_block_97, value=code_block_100.out0)

# group: UNTERNEHMENSNAME
code_block_101 = CodeBlock { "pdeInfoBox"; }
byName_22 = FamilyType.ByName(name=code_block_101)
byFamilyType_19 = FamilyInstance.ByFamilyType(familyType=byName_22)
code_block_102 = CodeBlock { "ID"; }
getParameterValueByName_19 = Element.GetParameterValueByName(element=byFamilyType_19, parameterName=code_block_102)
string_19 = StringInput("562379")
eq_19 = getParameterValueByName_19 == string_19
filterByBoolMask_19 = List.FilterByBoolMask(list=byFamilyType_19, mask=eq_19)
flatten_19 = List.Flatten(list=filterByBoolMask_19.in)
code_block_103 = CodeBlock { "isValue"; }
code_block_104 = CodeBlock { toggle: bool = true; }
code_block_105 = CodeBlock()  # same code as code_block_26
python_script_21 = Python(IN[0]=code_block_104, IN[1]=code_block_105)  # IronPython2; same code as python_script_6
code_block_106 = CodeBlock(seq=python_script_21) { seq[0]; seq[1]; seq[2]; seq[3]; seq[4]; seq[5]; seq[6]; seq[7]; seq[8]; seq[9]; }
setParameterByName_19 = Element.SetParameterByName(element=flatten_19, parameterName=code_block_103, value=code_block_106.out1)

# group: UNTERNEHMENSNAME
code_block_107 = CodeBlock { "pdeInfoBox"; }
byName_23 = FamilyType.ByName(name=code_block_107)
byFamilyType_20 = FamilyInstance.ByFamilyType(familyType=byName_23)
code_block_108 = CodeBlock { "ID"; }
getParameterValueByName_20 = Element.GetParameterValueByName(element=byFamilyType_20, parameterName=code_block_108)
string_20 = StringInput("657123")
eq_20 = getParameterValueByName_20 == string_20
filterByBoolMask_20 = List.FilterByBoolMask(list=byFamilyType_20, mask=eq_20)
flatten_20 = List.Flatten(list=filterByBoolMask_20.in)
code_block_109 = CodeBlock { "isValue"; }
code_block_110 = CodeBlock { toggle: bool = true; }
code_block_111 = CodeBlock()  # same code as code_block_26
python_script_22 = Python(IN[0]=code_block_110, IN[1]=code_block_111)  # IronPython2; same code as python_script_6
code_block_112 = CodeBlock(seq=python_script_22) { seq[0]; seq[1]; seq[2]; seq[3]; seq[4]; seq[5]; seq[6]; seq[7]; seq[8]; seq[9]; }
setParameterByName_20 = Element.SetParameterByName(element=flatten_20, parameterName=code_block_109, value=code_block_112.out2)

# group: Falsch platzierte RVT Verknüpfungen
code_block_113 = CodeBlock { "pdeInfoBox"; }
byName_24 = FamilyType.ByName(name=code_block_113)
byFamilyType_21 = FamilyInstance.ByFamilyType(familyType=byName_24)
code_block_114 = CodeBlock { "ID"; }
getParameterValueByName_21 = Element.GetParameterValueByName(element=byFamilyType_21, parameterName=code_block_114)
string_21 = StringInput("808878")
eq_21 = getParameterValueByName_21 == string_21
filterByBoolMask_21 = List.FilterByBoolMask(list=byFamilyType_21, mask=eq_21)
flatten_21 = List.Flatten(list=filterByBoolMask_21.in)
code_block_115 = CodeBlock { "isValue"; }
code_block_116 = CodeBlock { "OST_RvtLinks"; }
byName_25 = Category.ByName(name=code_block_116)
all_elements_of_category_4 = ElementsOfCategory(Category=byName_25)
code_block_117 = CodeBlock { "OST_ProjectBasePoint"; }
byName_26 = Category.ByName(name=code_block_117)
python_script_23 = Python(IN[0]=all_elements_of_category_4, IN[1]=byName_26)  # IronPython2; unwired: IN[2]
# ---------- python_script_23.python (71 lines) ----------
# Copyright(c) 2019, Dimitar Venkov
# @5devene, dimitar.ven@gmail.com
# www.badmonkeys.net

import clr

clr.AddReference("RevitNodes")
import Revit
clr.ImportExtensions(Revit.Elements)
clr.ImportExtensions(Revit.GeometryConversion)

clr.AddReference('RevitServices')
from RevitServices.Persistence import DocumentManager
doc = DocumentManager.Instance.CurrentDBDocument

clr.AddReference("RevitAPI")
from Autodesk.Revit.DB import FilteredElementCollector, RevitLinkType, ElementMulticategoryFilter, ElementId
import Autodesk.Revit.DB as DB

from System.Collections.Generic import List
import System

def tolist(obj1):
	if hasattr(obj1,"__iter__"): return obj1
	else: return [obj1]

links = UnwrapElement(tolist(IN[0]) )
cats = UnwrapElement(tolist(IN[1]) )
elements, transforms = [], []
OUT = elements, transforms

ueWrapper = None
wrappers = clr.GetClrType(Revit.Elements.ElementWrapper).GetMethods()
for w in wrappers:
	if w.ToString().startswith("Revit.Elements.UnknownElement"):
		ueWrapper = w
		break

for link in links:
	try:
		if RevitLinkType.IsLoaded(doc, link.GetTypeId() ):
			linkDoc = link.GetLinkDocument()
			
			if isinstance(cats[0], DB.Category):
				catId = List[DB.ElementId](c.Id for c in cats)
				filter = DB.ElementMulticategoryFilter(catId)
			elif isinstance(cats[0], DB.ElementType):
				types = List[System.Type](t.GetType() for t in cats)
				filter = DB.ElementMulticlassFilter(types)
			else:
				types = List[System.Type](cats)
				filter = DB.ElementMulticlassFilter(types)
			
			fec = FilteredElementCollector(linkDoc).WhereElementIsNotElementType().WherePasses(filter)
			linkEls = []
			for e in fec:
				try:
					linkEls.append(e.ToDSType(True) )
				except:
					if ueWrapper:
						linkEls.append(ueWrapper.Invoke(None, (e, True) ) )
			elements.append(linkEls)
			transforms.append(link.GetTotalTransform().ToCoordinateSystem(1) )
			fec.Dispose()
			filter.Dispose()
		else:
			elements.append('Linked document is unloaded')
			transforms.append(None)
	except Exception, ex:
		elements.append(str(ex) )
		transforms.append(None)
# ----------------------------------------
code_block_118 = CodeBlock(res=python_script_23) { res[0]; res[1]; }
watch = Watch(code_block_118.out1)
origin = CoordinateSystem.Origin(coordinateSystem=watch)
code_block_119 = CodeBlock { 0; }
byCoordinates = Point.ByCoordinates(x=code_block_119, y=code_block_119, z=code_block_119)
doesIntersect = Geometry.DoesIntersect(geometry=origin, other=byCoordinates)
countFalse_3 = List.CountFalse(list=doesIntersect)
python_script_24 = Python(IN[0]=countFalse_3)  # IronPython2; same code as python_script
setParameterByName_21 = Element.SetParameterByName(element=flatten_21, parameterName=code_block_115, value=python_script_24)
code_block_120 = CodeBlock { "autoColor"; }
anyFalse = List.AnyFalse(list=doesIntersect)
code_block_121 = CodeBlock { -1; }
code_block_122 = CodeBlock { 0; }
if_ = If(test=anyFalse, true=code_block_121, false=code_block_122)
setParameterByName_22 = Element.SetParameterByName(element=flatten_21, parameterName=code_block_120, value=if_)

# group: IMPORTED CAD LINKS IN 2D
code_block_123 = CodeBlock { "pdeInfoBox"; }
byName_27 = FamilyType.ByName(name=code_block_123)
byFamilyType_22 = FamilyInstance.ByFamilyType(familyType=byName_27)
code_block_124 = CodeBlock { "ID"; }
getParameterValueByName_22 = Element.GetParameterValueByName(element=byFamilyType_22, parameterName=code_block_124)
string_22 = StringInput("243913")
eq_22 = getParameterValueByName_22 == string_22
filterByBoolMask_22 = List.FilterByBoolMask(list=byFamilyType_22, mask=eq_22)
flatten_22 = List.Flatten(list=filterByBoolMask_22.in)
code_block_125 = CodeBlock { "isValue"; }
python_script_25 = Python()  # IronPython2; unwired: IN[0]; same code as python_script_2
code_block_126 = CodeBlock(x=python_script_25) { x[0]; }
parameters_2 = Element.Parameters(element=code_block_126)
id_2 = Parameter.Id(parameter=parameters_2)
code_block_127 = CodeBlock { -1007703; }
contains_2 = List.Contains(list=id_2@L2, item=code_block_127)
countFalse_4 = List.CountFalse(list=contains_2)
python_script_26 = Python(IN[0]=countFalse_4)  # IronPython2; same code as python_script
setParameterByName_23 = Element.SetParameterByName(element=flatten_22, parameterName=code_block_125, value=python_script_26)

# group: COUNT LINKED CAD FILES
code_block_128 = CodeBlock { "pdeInfoBox"; }
byName_28 = FamilyType.ByName(name=code_block_128)
byFamilyType_23 = FamilyInstance.ByFamilyType(familyType=byName_28)
code_block_129 = CodeBlock { "ID"; }
getParameterValueByName_23 = Element.GetParameterValueByName(element=byFamilyType_23, parameterName=code_block_129)
string_23 = StringInput("262440")
eq_23 = getParameterValueByName_23 == string_23
filterByBoolMask_23 = List.FilterByBoolMask(list=byFamilyType_23, mask=eq_23)
flatten_23 = List.Flatten(list=filterByBoolMask_23.in)
code_block_130 = CodeBlock { "isValue"; }
python_script_27 = Python()  # IronPython2; unwired: IN[0]; same code as python_script_2
code_block_131 = CodeBlock(x=python_script_27) { x[0]; }
python_script_28 = Python(IN[0]=code_block_131)  # IronPython2
# ---------- python_script_28.python (24 lines) ----------
#dynre*
#wloewz
#ImportInstanceIsLinked

import clr
clr.AddReference('RevitAPI')
from Autodesk.Revit.DB import *
import Autodesk

clr.AddReference("RevitServices")
import RevitServices
from RevitServices.Persistence import DocumentManager

doc = DocumentManager.Instance.CurrentDBDocument
impinst = UnwrapElement(IN[0])
booleans = []
for item in impinst:
	if item.GetType().ToString() == "Autodesk.Revit.DB.ImportInstance":
		if item.IsLinked: booleans.append(True)
		else: booleans.append(False)
	else: booleans.append(False)
OUT = (booleans)

#dynre*
# ----------------------------------------
countFalse_5 = List.CountFalse(list=python_script_28)
python_script_29 = Python(IN[0]=countFalse_5)  # IronPython2; same code as python_script
setParameterByName_24 = Element.SetParameterByName(element=flatten_23, parameterName=code_block_130, value=python_script_29)

# group: COUNT IMPORTED CAD FILES
code_block_132 = CodeBlock { "pdeInfoBox"; }
byName_29 = FamilyType.ByName(name=code_block_132)
byFamilyType_24 = FamilyInstance.ByFamilyType(familyType=byName_29)
code_block_133 = CodeBlock { "ID"; }
getParameterValueByName_24 = Element.GetParameterValueByName(element=byFamilyType_24, parameterName=code_block_133)
string_24 = StringInput("644809")
eq_24 = getParameterValueByName_24 == string_24
filterByBoolMask_24 = List.FilterByBoolMask(list=byFamilyType_24, mask=eq_24)
flatten_24 = List.Flatten(list=filterByBoolMask_24.in)
code_block_134 = CodeBlock { "isValue"; }
python_script_30 = Python()  # IronPython2; unwired: IN[0]; same code as python_script_2
code_block_135 = CodeBlock(x=python_script_30) { x[0]; }
python_script_31 = Python(IN[0]=code_block_135)  # IronPython2; same code as python_script_28
countTrue_2 = List.CountTrue(list=python_script_31)
python_script_32 = Python(IN[0]=countTrue_2)  # IronPython2; same code as python_script
setParameterByName_25 = Element.SetParameterByName(element=flatten_24, parameterName=code_block_134, value=python_script_32)

# group: PURGABLE ELEMENTS
code_block_136 = CodeBlock { "pdeInfoBox"; }
byName_30 = FamilyType.ByName(name=code_block_136)
byFamilyType_25 = FamilyInstance.ByFamilyType(familyType=byName_30)
code_block_137 = CodeBlock { "ID"; }
getParameterValueByName_25 = Element.GetParameterValueByName(element=byFamilyType_25, parameterName=code_block_137)
string_25 = StringInput("651379")
eq_25 = getParameterValueByName_25 == string_25
filterByBoolMask_25 = List.FilterByBoolMask(list=byFamilyType_25, mask=eq_25)
flatten_25 = List.Flatten(list=filterByBoolMask_25.in)
code_block_138 = CodeBlock { "isValue"; }
code_block_139 = CodeBlock { "\n"; }
purgable_elements = Python()  # IronPython2; unwired: IN[0]
# ---------- purgable_elements.python (36 lines) ----------
import clr
import System
from System.Collections.Generic import List

clr.AddReference("RevitAPI")
import Autodesk
from Autodesk.Revit.DB import *

clr.AddReference("RevitServices")
import RevitServices
from RevitServices.Persistence import DocumentManager
from RevitServices.Transactions import TransactionManager

doc = DocumentManager.Instance.CurrentDBDocument

#GetPurgeableElements by Oliver E Green 
def GetPurgeableElements(doc, rule_id_list):
	failure_messages = PerformanceAdviser.GetPerformanceAdviser().ExecuteRules(doc, rule_id_list)
	if failure_messages.Count > 0:
		purgeable_element_ids = failure_messages[0].GetFailingElements()
		return purgeable_element_ids

#A constant 
PURGE_GUID = "e8c63650-70b7-435a-9010-ec97660c1bda"

#A generic list of PerformanceAdviserRuleIds as required by the ExecuteRules method
rule_id_list = List[PerformanceAdviserRuleId]()

#Iterating through all PerformanceAdviser rules looking to find that which matches PURGE_GUID
for rule_id in PerformanceAdviser.GetPerformanceAdviser().GetAllRuleIds():
	if str(rule_id.Guid) == PURGE_GUID:
		rule_id_list.Add(rule_id)
		break

#Attempting to retrieve the elements which can be purged
OUT = GetPurgeableElements(doc, rule_id_list)
# ----------------------------------------
element_by_id = ElementById(Id=purgable_elements)
getCategory = Element.GetCategory(element=element_by_id)
list_clean = Python(IN[0]=getCategory)  # IronPython2
# ---------- list_clean.python (15 lines) ----------
def ClearList(primList):
    result = []
    for sublist in primList:
        if sublist is "":
            continue
        elif sublist is None:
            continue 
        if isinstance(sublist, list):
             sublist = ClearList(sublist)
             if not sublist:
                 continue
        result.append(sublist)
    return result

OUT = ClearList(IN[0])
# ----------------------------------------
groupByKey = List.GroupByKey(list=list_clean, keys=list_clean)
code_block_140 = CodeBlock { 0; }
getItemAtIndex_2 = List.GetItemAtIndex(list=groupByKey.groups@L2, index=code_block_140)
count_3 = List.Count(list=groupByKey.groups@L2)
sortByKey = List.SortByKey(list=getItemAtIndex_2, keys=count_3)
code_block_141 = CodeBlock(a=sortByKey.sortedKeys, b=sortByKey.sortedList) { "(" + a +")" +" " + b; }
count_4 = List.Count(list=code_block_141)
code_block_142 = CodeBlock(a=count_4) { a-36; }
dropItems = List.DropItems(list=code_block_141, amount=code_block_142)
join_2 = String.Join(separator=code_block_139, string0=dropItems)
setParameterByName_26 = Element.SetParameterByName(element=flatten_25, parameterName=code_block_138, value=join_2)

# group: COUNT DESIGN OPTIONS
code_block_143 = CodeBlock { "pdeInfoBox"; }
byName_31 = FamilyType.ByName(name=code_block_143)
byFamilyType_26 = FamilyInstance.ByFamilyType(familyType=byName_31)
code_block_144 = CodeBlock { "ID"; }
getParameterValueByName_26 = Element.GetParameterValueByName(element=byFamilyType_26, parameterName=code_block_144)
string_26 = StringInput("106179")
eq_26 = getParameterValueByName_26 == string_26
filterByBoolMask_26 = List.FilterByBoolMask(list=byFamilyType_26, mask=eq_26)
flatten_26 = List.Flatten(list=filterByBoolMask_26.in)
code_block_145 = CodeBlock { "isValue"; }
design_options = Python()  # IronPython2; unwired: IN[0]
# ---------- design_options.python (39 lines) ----------
#Copyright(c) 2015, Konrad Sobon
# @arch_laboratory, http://archi-lab.net

import clr
clr.AddReference('ProtoGeometry')
from Autodesk.DesignScript.Geometry import *

# Import ToDSType(bool) extension method
clr.AddReference("RevitNodes")
import Revit
clr.ImportExtensions(Revit.Elements)

# Import DocumentManager and TransactionManager
clr.AddReference("RevitServices")
import RevitServices
from RevitServices.Persistence import DocumentManager
from RevitServices.Transactions import TransactionManager

from System.Collections.Generic import *

# Import RevitAPI
clr.AddReference("RevitAPI")
import Autodesk
from Autodesk.Revit.DB import *

doc = DocumentManager.Instance.CurrentDBDocument
uiapp = DocumentManager.Instance.CurrentUIApplication
app = uiapp.Application

#The inputs to this node will be stored as a list in the IN variable.
dataEnteringNode = IN

#get all design options in the model
designOp = FilteredElementCollector(doc).OfClass(DesignOption).ToElements()
designOpNames = []
for i in designOp:
	designOpNames.append(i.Name.ToString())
#Assign your output to the OUT variable
OUT = designOp
# ----------------------------------------
python_script_33 = Python(IN[0]=design_options)  # IronPython2
# ---------- python_script_33.python (21 lines) ----------
#Copyright(c) 2016, Dimitar Venkov
# @5devene, dimitar.ven@gmail.com

import clr

def tolist(obj1):
	if hasattr(obj1,"__iter__"): return obj1
	else: return [obj1]

def output1(l1):
	if len(l1) == 1: return l1[0]
	else: return l1

num1 = tolist(IN[0])
out1 = []
for i in xrange(len(num1)):
	s1 = str(num1[i])
	if s1[-2:] == ".0": out1.append(s1[:-2])
	else: out1.append(s1)

OUT = output1(out1)
# ----------------------------------------
count_5 = List.Count(list=python_script_33)
toString = Python(IN[0]=count_5)  # IronPython2; same code as python_script_33
setParameterByName_27 = Element.SetParameterByName(element=flatten_26, parameterName=code_block_145, value=toString)

# group: COUNT "???" VIEWS
code_block_146 = CodeBlock { "pdeInfoBox"; }
byName_32 = FamilyType.ByName(name=code_block_146)
byFamilyType_27 = FamilyInstance.ByFamilyType(familyType=byName_32)
code_block_147 = CodeBlock { "ID"; }
getParameterValueByName_27 = Element.GetParameterValueByName(element=byFamilyType_27, parameterName=code_block_147)
string_27 = StringInput("274309")
eq_27 = getParameterValueByName_27 == string_27
filterByBoolMask_27 = List.FilterByBoolMask(list=byFamilyType_27, mask=eq_27)
flatten_27 = List.Flatten(list=filterByBoolMask_27.in)
code_block_148 = CodeBlock { "isValue"; }
python_script_34 = Python()  # IronPython2; graph input
# ---------- python_script_34.python (100 lines) ----------
#Copyright(c) 2015, Konrad Sobon
# @arch_laboratory, http://archi-lab.net

import clr
clr.AddReference('ProtoGeometry')
from Autodesk.DesignScript.Geometry import *

# Import DocumentManager and TransactionManager
clr.AddReference("RevitServices")
import RevitServices
from RevitServices.Persistence import DocumentManager
from RevitServices.Transactions import TransactionManager

# Import RevitAPI
clr.AddReference("RevitAPI")
import Autodesk
from Autodesk.Revit.DB import *

doc = DocumentManager.Instance.CurrentDBDocument
uiapp = DocumentManager.Instance.CurrentUIApplication
app = uiapp.Application

from System.Collections.Generic import *

# Import ToDSType(bool) extension method
clr.AddReference("RevitNodes")
import Revit
clr.ImportExtensions(Revit.Elements)

#The inputs to this node will be stored as a list in the IN variable.
dataEnteringNode = IN

#collect all views in the model
collector = FilteredElementCollector(doc)
views = collector.OfClass(View).ToElements()

#sort views into separate lists based on view type
areaPlans, ceilingPlans, columnSchedules = [], [], []
costReport, details, draftingViews = [], [], []
drawingSheets, elevations, engineetingPlans = [], [], []
floorPlans, internal, legends, loadReports = [], [], [], []
panelSchedules, pressureLossReports, renderings = [], [], []
reports, schedules, sections, threeD = [], [], [], []
undefined, walkthrough = [], []
for i in views:
	if not i.IsTemplate:
		if i.ViewType == ViewType.AreaPlan:
			areaPlans.append(i.ToDSType(True))
		elif i.ViewType == ViewType.CeilingPlan:
			ceilingPlans.append(i.ToDSType(True))
		elif i.ViewType == ViewType.ColumnSchedule:
			columnSchedules.append(i.ToDSType(True))
		elif i.ViewType == ViewType.CostReport:
			costReport.append(i.ToDSType(True))
		elif i.ViewType == ViewType.Detail:
			details.append(i.ToDSType(True))
		elif i.ViewType == ViewType.DraftingView:
			draftingViews.append(i.ToDSType(True))
		elif i.ViewType == ViewType.DrawingSheet:
			drawingSheets.append(i.ToDSType(True))
		elif i.ViewType == ViewType.Elevation:
			elevations.append(i.ToDSType(True))
		elif i.ViewType == ViewType.EngineeringPlan:
			engineetingPlans.append(i.ToDSType(True))
		elif i.ViewType == ViewType.FloorPlan:
			floorPlans.append(i.ToDSType(True))
		elif i.ViewType == ViewType.Internal:
			internal.append(i.ToDSType(True))
		elif i.ViewType == ViewType.Legend:
			legends.append(i.ToDSType(True))
		elif i.ViewType == ViewType.LoadsReport:
			loadReports.append(i.ToDSType(True))
		elif i.ViewType == ViewType.PanelSchedule:
			panelSchedules.append(i.ToDSType(True))
		elif i.ViewType == ViewType.PresureLossReport:
			pressureLossReports.append(i.ToDSType(True))
		elif i.ViewType == ViewType.Rendering:
			renderings.append(i.ToDSType(True))
		elif i.ViewType == ViewType.Report:
			reports.append(i.ToDSType(True))
		elif i.ViewType == ViewType.Schedule:
			schedules.append(i.ToDSType(True))
		elif i.ViewType == ViewType.Section:
			sections.append(i.ToDSType(True))
		elif i.ViewType == ViewType.ThreeD:
			threeD.append(i.ToDSType(True))
		elif i.ViewType == ViewType.Undefined:
			undefined.append(i.ToDSType(True))
		elif i.ViewType == ViewType.Walkthrough:
			walkthrough.append(i.ToDSType(True))
		else:
			continue

#Assign your output to the OUT variable
OUT = areaPlans, ceilingPlans, columnSchedules, costReport, \
	details, draftingViews, drawingSheets, elevations, \
	engineetingPlans, floorPlans, internal, legends, \
	loadReports, panelSchedules, pressureLossReports, \
	renderings, reports, schedules, sections, threeD, \
	undefined, walkthrough
# ----------------------------------------
flatten_28 = List.Flatten(list=python_script_34)
code_block_149 = CodeBlock { "porr_Disziplin"; "porr_Phase"; "porr_Ansichtstyp"; "porr_Ansichtsgruppe"; }
list_create = List.Create(item0=code_block_149.out0, item1=code_block_149.out1, item2=code_block_149.out2, item3=code_block_149.out3)
getParameterValueByName_28 = Element.GetParameterValueByName(element=flatten_28@L1, parameterName=list_create)
clean = Python(IN[0]=getParameterValueByName_28)  # "List.Clean"; IronPython2
# ---------- clean.python (17 lines) ----------
#https://stackoverflow.com/questions/30488751/clean-list-or-list-of-lists-of-all-none-or-empty-lists-in-python

def ClearList(primList):
    result = []
    for sublist in primList:
        if sublist is "":
            continue
        elif sublist is None:
            continue 
        if isinstance(sublist, list):
             sublist = ClearList(sublist)
             if not sublist:
                 continue
        result.append(sublist)
    return result

OUT = ClearList(IN[0])
# ----------------------------------------
count_6 = List.Count(list=clean@L2)
code_block_150 = CodeBlock(x=count_6) { (x == 4) ? true : false; }
countFalse_6 = List.CountFalse(list=code_block_150)
toString_2 = Python(IN[0]=countFalse_6)  # IronPython2; same code as python_script_33
setParameterByName_28 = Element.SetParameterByName(element=flatten_27, parameterName=code_block_148, value=toString_2)

# group: COUNT IN-PLACE FAMILIES
code_block_151 = CodeBlock { "pdeInfoBox"; }
byName_33 = FamilyType.ByName(name=code_block_151)
byFamilyType_28 = FamilyInstance.ByFamilyType(familyType=byName_33)
code_block_152 = CodeBlock { "ID"; }
getParameterValueByName_29 = Element.GetParameterValueByName(element=byFamilyType_28, parameterName=code_block_152)
string_28 = StringInput("465371")
eq_28 = getParameterValueByName_29 == string_28
filterByBoolMask_28 = List.FilterByBoolMask(list=byFamilyType_28, mask=eq_28)
flatten_29 = List.Flatten(list=filterByBoolMask_28.in)
code_block_153 = CodeBlock { "isValue"; }
element_types = ElementTypes("Family")
all_elements_of_type = ElementsOfType(element_type=element_types)
python_script_35 = Python(IN[0]=all_elements_of_type)  # IronPython2
# ---------- python_script_35.python (13 lines) ----------
import clr
import System
clr.AddReference('RevitAPI')
from Autodesk.Revit.DB import *

def IsInPlace(item):
	if hasattr(item, "IsInPlace"): return item.IsInPlace
	else: return None

items = UnwrapElement(IN[0])

if isinstance(IN[0], list): OUT = [IsInPlace(x) for x in items]
else: OUT = IsInPlace(items)
# ----------------------------------------
countTrue_3 = List.CountTrue(list=python_script_35)
toString_3 = Python(IN[0]=countTrue_3)  # IronPython2; same code as python_script_33
setParameterByName_29 = Element.SetParameterByName(element=flatten_29, parameterName=code_block_153, value=toString_3)

# group: COUNT MODELGROUPS
code_block_154 = CodeBlock { "pdeInfoBox"; }
byName_34 = FamilyType.ByName(name=code_block_154)
byFamilyType_29 = FamilyInstance.ByFamilyType(familyType=byName_34)
code_block_155 = CodeBlock { "ID"; }
getParameterValueByName_30 = Element.GetParameterValueByName(element=byFamilyType_29, parameterName=code_block_155)
string_29 = StringInput("576910")
eq_29 = getParameterValueByName_30 == string_29
filterByBoolMask_29 = List.FilterByBoolMask(list=byFamilyType_29, mask=eq_29)
flatten_30 = List.Flatten(list=filterByBoolMask_29.in)
code_block_156 = CodeBlock { "isValue"; }
code_block_157 = CodeBlock { "OST_IOSModelGroups"; }
byName_35 = Category.ByName(name=code_block_157)
all_elements_of_category_5 = ElementsOfCategory(Category=byName_35)
count_7 = List.Count(list=all_elements_of_category_5)
toString_4 = Python(IN[0]=count_7)  # IronPython2; same code as python_script_33
setParameterByName_30 = Element.SetParameterByName(element=flatten_30, parameterName=code_block_156, value=toString_4)

# group: COUNT DETAIL GROUPS
code_block_158 = CodeBlock { "pdeInfoBox"; }
byName_36 = FamilyType.ByName(name=code_block_158)
byFamilyType_30 = FamilyInstance.ByFamilyType(familyType=byName_36)
code_block_159 = CodeBlock { "ID"; }
getParameterValueByName_31 = Element.GetParameterValueByName(element=byFamilyType_30, parameterName=code_block_159)
string_30 = StringInput("069437")
eq_30 = getParameterValueByName_31 == string_30
filterByBoolMask_30 = List.FilterByBoolMask(list=byFamilyType_30, mask=eq_30)
flatten_31 = List.Flatten(list=filterByBoolMask_30.in)
code_block_160 = CodeBlock { "isValue"; }
python_script_36 = Python()  # IronPython2; graph input
# ---------- python_script_36.python (35 lines) ----------
#Copyright(c) 2015, Konrad Sobon
# @arch_laboratory, http://archi-lab.net

import clr
clr.AddReference('ProtoGeometry')
from Autodesk.DesignScript.Geometry import *

# Import DocumentManager and TransactionManager
clr.AddReference("RevitServices")
import RevitServices
from RevitServices.Persistence import DocumentManager
from RevitServices.Transactions import TransactionManager

# Import RevitAPI
clr.AddReference("RevitAPI")
import Autodesk
from Autodesk.Revit.DB import *

doc = DocumentManager.Instance.CurrentDBDocument
uiapp = DocumentManager.Instance.CurrentUIApplication
app = uiapp.Application

from System.Collections.Generic import *

#The inputs to this node will be stored as a list in the IN variable.
dataEnteringNode = IN

collector = FilteredElementCollector(doc)
groups = collector.OfCategory(BuiltInCategory.OST_IOSDetailGroups).WhereElementIsNotElementType().ToElements()

groupNames = []
for i in groups:
	groupNames.append(i.Name)

OUT = groups
# ----------------------------------------
count_8 = List.Count(list=python_script_36)
toString_5 = Python(IN[0]=count_8)  # IronPython2; same code as python_script_33
setParameterByName_31 = Element.SetParameterByName(element=flatten_31, parameterName=code_block_160, value=toString_5)

# group: COUNT WARNINGS
code_block_161 = CodeBlock { "pdeInfoBox"; }
byName_37 = FamilyType.ByName(name=code_block_161)
byFamilyType_31 = FamilyInstance.ByFamilyType(familyType=byName_37)
code_block_162 = CodeBlock { "ID"; }
getParameterValueByName_32 = Element.GetParameterValueByName(element=byFamilyType_31, parameterName=code_block_162)
string_31 = StringInput("254982")
eq_31 = getParameterValueByName_32 == string_31
filterByBoolMask_31 = List.FilterByBoolMask(list=byFamilyType_31, mask=eq_31)
flatten_32 = List.Flatten(list=filterByBoolMask_31.in)
code_block_163 = CodeBlock { "isValue"; }
current = Document.Current()
getWarnings = Warning.GetWarnings(document=current)
count_9 = List.Count(list=getWarnings)
toString_6 = Python(IN[0]=count_9)  # IronPython2; same code as python_script_33
setParameterByName_32 = Element.SetParameterByName(element=flatten_32, parameterName=code_block_163, value=toString_6)
