# Dynamo graph 002-Refresh-Dashboard-Values.dyn (Dynamo 2.12.0.5650)

# group: EF
code_block = CodeBlock { "pdeInfoBox"; }
byName = FamilyType.ByName(name=code_block)
byFamilyType = FamilyInstance.ByFamilyType(familyType=byName)
code_block_2 = CodeBlock { "ID"; }
getParameterValueByName = Element.GetParameterValueByName(element=byFamilyType, parameterName=code_block_2)
string = StringInput("217716")
eq = getParameterValueByName == string
filterByBoolMask = List.FilterByBoolMask(list=byFamilyType, mask=eq)
flatten = List.Flatten(list=filterByBoolMask.in)
code_block_3 = CodeBlock { "isValue"; }
code_block_4 = CodeBlock { "OST_Areas"; }
byName_2 = Category.ByName(name=code_block_4)
all_elements_of_category = ElementsOfCategory(Category=byName_2)
code_block_5 = CodeBlock { "MCI-HL-N"; }
getParameterValueByName_2 = Element.GetParameterValueByName(element=all_elements_of_category, parameterName=code_block_5)
code_block_6 = CodeBlock(x=getParameterValueByName_2) { x<=3 || x==5? true: false; }
filterByBoolMask_2 = List.FilterByBoolMask(list=all_elements_of_category, mask=code_block_6)
python_script = Python(IN[0]=filterByBoolMask_2.in)  # IronPython2
# ---------- python_script.python (32 lines) ----------
#dynre*
#orttvs
#GetRoomArea

import clr
clr.AddReference('RevitAPI')
from Autodesk.Revit.DB import *

clr.AddReference('RevitNodes')
import Revit
clr.ImportExtensions(Revit.GeometryConversion)
clr.ImportExtensions(Revit.Elements)

clr.AddReference('RevitServices')
import RevitServices
from RevitServices.Persistence import DocumentManager
from RevitServices.Transactions import TransactionManager

doc = DocumentManager.Instance.CurrentDBDocument

#converting
elements = UnwrapElement(IN[0])
output = []

#getting
for element in elements:
	a = element.get_Parameter(BuiltInParameter.ROOM_AREA).AsDouble()
	output.append(a)
	
OUT = output

#dynre*
# ----------------------------------------
code_block_7 = CodeBlock { 0.09290304; }
mul = python_script * code_block_7
code_block_8 = CodeBlock(x=mul) { x != ""? x : 0; }
sum = Math.Sum(values=code_block_8)
python_script_2 = Python(IN[0]=sum)  # IronPython2
# ---------- python_script_2.python (1 lines) ----------
OUT = str(round(IN[0], 2))
# ----------------------------------------
setParameterByName = Element.SetParameterByName(element=flatten, parameterName=code_block_3, value=python_script_2)

# group: BGFa
code_block_9 = CodeBlock { "pdeInfoBox"; }
byName_3 = FamilyType.ByName(name=code_block_9)
byFamilyType_2 = FamilyInstance.ByFamilyType(familyType=byName_3)
code_block_10 = CodeBlock { "ID"; }
getParameterValueByName_3 = Element.GetParameterValueByName(element=byFamilyType_2, parameterName=code_block_10)
string_2 = StringInput("766710")
eq_2 = getParameterValueByName_3 == string_2
filterByBoolMask_3 = List.FilterByBoolMask(list=byFamilyType_2, mask=eq_2)
flatten_2 = List.Flatten(list=filterByBoolMask_3.in)
code_block_11 = CodeBlock { "isValue"; }
code_block_12 = CodeBlock { "OST_Areas"; }
byName_4 = Category.ByName(name=code_block_12)
all_elements_of_category_2 = ElementsOfCategory(Category=byName_4)
code_block_13 = CodeBlock { "MCI-HL-N"; }
getParameterValueByName_4 = Element.GetParameterValueByName(element=all_elements_of_category_2, parameterName=code_block_13)
code_block_14 = CodeBlock(x=getParameterValueByName_4) { x==1? true: false; }
filterByBoolMask_4 = List.FilterByBoolMask(list=all_elements_of_category_2, mask=code_block_14)
python_script_3 = Python(IN[0]=filterByBoolMask_4.in)  # IronPython2; same code as python_script
code_block_15 = CodeBlock { 0.09290304; }
mul_2 = python_script_3 * code_block_15
code_block_16 = CodeBlock(x=mul_2) { x != ""? x : 0; }
sum_2 = Math.Sum(values=code_block_16)
python_script_4 = Python(IN[0]=sum_2)  # IronPython2; same code as python_script_2
setParameterByName_2 = Element.SetParameterByName(element=flatten_2, parameterName=code_block_11, value=python_script_4)

# group: BGFb
code_block_17 = CodeBlock { "pdeInfoBox"; }
byName_5 = FamilyType.ByName(name=code_block_17)
byFamilyType_3 = FamilyInstance.ByFamilyType(familyType=byName_5)
code_block_18 = CodeBlock { "ID"; }
getParameterValueByName_5 = Element.GetParameterValueByName(element=byFamilyType_3, parameterName=code_block_18)
string_3 = StringInput("697968")
eq_3 = getParameterValueByName_5 == string_3
filterByBoolMask_5 = List.FilterByBoolMask(list=byFamilyType_3, mask=eq_3)
flatten_3 = List.Flatten(list=filterByBoolMask_5.in)
code_block_19 = CodeBlock { "isValue"; }
code_block_20 = CodeBlock { "OST_Areas"; }
byName_6 = Category.ByName(name=code_block_20)
all_elements_of_category_3 = ElementsOfCategory(Category=byName_6)
code_block_21 = CodeBlock { "MCI-HL-N"; }
getParameterValueByName_6 = Element.GetParameterValueByName(element=all_elements_of_category_3, parameterName=code_block_21)
code_block_22 = CodeBlock(x=getParameterValueByName_6) { x==2? true: false; }
filterByBoolMask_6 = List.FilterByBoolMask(list=all_elements_of_category_3, mask=code_block_22)
python_script_5 = Python(IN[0]=filterByBoolMask_6.in)  # IronPython2; same code as python_script
code_block_23 = CodeBlock { 0.09290304; }
mul_3 = python_script_5 * code_block_23
code_block_24 = CodeBlock(x=mul_3) { x != ""? x : 0; }
sum_3 = Math.Sum(values=code_block_24)
python_script_6 = Python(IN[0]=sum_3)  # IronPython2; same code as python_script_2
setParameterByName_3 = Element.SetParameterByName(element=flatten_3, parameterName=code_block_19, value=python_script_6)

# group: BGFc
code_block_25 = CodeBlock { "pdeInfoBox"; }
byName_7 = FamilyType.ByName(name=code_block_25)
byFamilyType_4 = FamilyInstance.ByFamilyType(familyType=byName_7)
code_block_26 = CodeBlock { "ID"; }
getParameterValueByName_7 = Element.GetParameterValueByName(element=byFamilyType_4, parameterName=code_block_26)
string_4 = StringInput("526833")
eq_4 = getParameterValueByName_7 == string_4
filterByBoolMask_7 = List.FilterByBoolMask(list=byFamilyType_4, mask=eq_4)
flatten_4 = List.Flatten(list=filterByBoolMask_7.in)
code_block_27 = CodeBlock { "isValue"; }
code_block_28 = CodeBlock { "OST_Areas"; }
byName_8 = Category.ByName(name=code_block_28)
all_elements_of_category_4 = ElementsOfCategory(Category=byName_8)
code_block_29 = CodeBlock { "MCI-HL-N"; }
getParameterValueByName_8 = Element.GetParameterValueByName(element=all_elements_of_category_4, parameterName=code_block_29)
code_block_30 = CodeBlock(x=getParameterValueByName_8) { x==3? true: false; }
filterByBoolMask_8 = List.FilterByBoolMask(list=all_elements_of_category_4, mask=code_block_30)
python_script_7 = Python(IN[0]=filterByBoolMask_8.in)  # IronPython2; same code as python_script
code_block_31 = CodeBlock { 0.09290304; }
mul_4 = python_script_7 * code_block_31
code_block_32 = CodeBlock(x=mul_4) { x != ""? x : 0; }
sum_4 = Math.Sum(values=code_block_32)
python_script_8 = Python(IN[0]=sum_4)  # IronPython2; same code as python_script_2
setParameterByName_4 = Element.SetParameterByName(element=flatten_4, parameterName=code_block_27, value=python_script_8)

# group: TG BGFa
code_block_33 = CodeBlock { "pdeInfoBox"; }
byName_9 = FamilyType.ByName(name=code_block_33)
byFamilyType_5 = FamilyInstance.ByFamilyType(familyType=byName_9)
code_block_34 = CodeBlock { "ID"; }
getParameterValueByName_9 = Element.GetParameterValueByName(element=byFamilyType_5, parameterName=code_block_34)
string_5 = StringInput("246976")
eq_5 = getParameterValueByName_9 == string_5
filterByBoolMask_9 = List.FilterByBoolMask(list=byFamilyType_5, mask=eq_5)
flatten_5 = List.Flatten(list=filterByBoolMask_9.in)
code_block_35 = CodeBlock { "isValue"; }
code_block_36 = CodeBlock { "OST_Areas"; }
byName_10 = Category.ByName(name=code_block_36)
all_elements_of_category_5 = ElementsOfCategory(Category=byName_10)
code_block_37 = CodeBlock { "MCI-HL-N"; }
getParameterValueByName_10 = Element.GetParameterValueByName(element=all_elements_of_category_5, parameterName=code_block_37)
code_block_38 = CodeBlock(x=getParameterValueByName_10) { x==4? true: false; }
filterByBoolMask_10 = List.FilterByBoolMask(list=all_elements_of_category_5, mask=code_block_38)
python_script_9 = Python(IN[0]=filterByBoolMask_10.in)  # IronPython2; same code as python_script
code_block_39 = CodeBlock { 0.09290304; }
mul_5 = python_script_9 * code_block_39
code_block_40 = CodeBlock(x=mul_5) { x != ""? x : 0; }
sum_5 = Math.Sum(values=code_block_40)
python_script_10 = Python(IN[0]=sum_5)  # IronPython2; same code as python_script_2
setParameterByName_5 = Element.SetParameterByName(element=flatten_5, parameterName=code_block_35, value=python_script_10)

# group: UGF
code_block_41 = CodeBlock { "pdeInfoBox"; }
byName_11 = FamilyType.ByName(name=code_block_41)
byFamilyType_6 = FamilyInstance.ByFamilyType(familyType=byName_11)
code_block_42 = CodeBlock { "ID"; }
getParameterValueByName_11 = Element.GetParameterValueByName(element=byFamilyType_6, parameterName=code_block_42)
string_6 = StringInput("821969")
eq_6 = getParameterValueByName_11 == string_6
filterByBoolMask_11 = List.FilterByBoolMask(list=byFamilyType_6, mask=eq_6)
flatten_6 = List.Flatten(list=filterByBoolMask_11.in)
code_block_43 = CodeBlock { "isValue"; }
code_block_44 = CodeBlock { "OST_Areas"; }
byName_12 = Category.ByName(name=code_block_44)
all_elements_of_category_6 = ElementsOfCategory(Category=byName_12)
code_block_45 = CodeBlock { "MCI-HL-N"; }
getParameterValueByName_12 = Element.GetParameterValueByName(element=all_elements_of_category_6, parameterName=code_block_45)
code_block_46 = CodeBlock(x=getParameterValueByName_12) { x==5? true: false; }
filterByBoolMask_12 = List.FilterByBoolMask(list=all_elements_of_category_6, mask=code_block_46)
python_script_11 = Python(IN[0]=filterByBoolMask_12.in)  # IronPython2; same code as python_script
code_block_47 = CodeBlock { 0.09290304; }
mul_6 = python_script_11 * code_block_47
code_block_48 = CodeBlock(x=mul_6) { x != ""? x : 0; }
sum_6 = Math.Sum(values=code_block_48)
python_script_12 = Python(IN[0]=sum_6)  # IronPython2; same code as python_script_2
setParameterByName_6 = Element.SetParameterByName(element=flatten_6, parameterName=code_block_43, value=python_script_12)

# group: ## Nicht angegeben
code_block_49 = CodeBlock { "pdeInfoBox"; }
byName_13 = FamilyType.ByName(name=code_block_49)
byFamilyType_7 = FamilyInstance.ByFamilyType(familyType=byName_13)
code_block_50 = CodeBlock { "ID"; }
getParameterValueByName_13 = Element.GetParameterValueByName(element=byFamilyType_7, parameterName=code_block_50)
string_7 = StringInput("208842")
eq_7 = getParameterValueByName_13 == string_7
filterByBoolMask_13 = List.FilterByBoolMask(list=byFamilyType_7, mask=eq_7)
flatten_7 = List.Flatten(list=filterByBoolMask_13.in)
code_block_51 = CodeBlock { "isValue"; }
code_block_52 = CodeBlock { "OST_Areas"; }
byName_14 = Category.ByName(name=code_block_52)
all_elements_of_category_7 = ElementsOfCategory(Category=byName_14)
code_block_53 = CodeBlock { "MCI-HL-N"; }
getParameterValueByName_14 = Element.GetParameterValueByName(element=all_elements_of_category_7, parameterName=code_block_53)
code_block_54 = CodeBlock(x=getParameterValueByName_14) { x==""? true: false; }
filterByBoolMask_14 = List.FilterByBoolMask(list=all_elements_of_category_7, mask=code_block_54)
python_script_13 = Python(IN[0]=filterByBoolMask_14.in)  # IronPython2; same code as python_script
code_block_55 = CodeBlock { 0.09290304; }
mul_7 = python_script_13 * code_block_55
code_block_56 = CodeBlock(x=mul_7) { x != ""? x : 0; }
sum_7 = Math.Sum(values=code_block_56)
python_script_14 = Python(IN[0]=sum_7)  # IronPython2; same code as python_script_2
setParameterByName_7 = Element.SetParameterByName(element=flatten_7, parameterName=code_block_51, value=python_script_14)

# group: NF
code_block_57 = CodeBlock { "pdeInfoBox"; }
byName_15 = FamilyType.ByName(name=code_block_57)
byFamilyType_8 = FamilyInstance.ByFamilyType(familyType=byName_15)
code_block_58 = CodeBlock { "ID"; }
getParameterValueByName_15 = Element.GetParameterValueByName(element=byFamilyType_8, parameterName=code_block_58)
string_8 = StringInput("746401")
eq_8 = getParameterValueByName_15 == string_8
filterByBoolMask_15 = List.FilterByBoolMask(list=byFamilyType_8, mask=eq_8)
flatten_8 = List.Flatten(list=filterByBoolMask_15.in)
code_block_59 = CodeBlock { "isValue"; }
code_block_60 = CodeBlock { "OST_Rooms"; }
byName_16 = Category.ByName(name=code_block_60)
all_elements_of_category_8 = ElementsOfCategory(Category=byName_16)
code_block_61 = CodeBlock { "MCI-HL-ÖNORM B1800 NRF"; }
getParameterValueByName_16 = Element.GetParameterValueByName(element=all_elements_of_category_8, parameterName=code_block_61)
code_block_62 = CodeBlock(x=getParameterValueByName_16) { x=="NF"? true: false; }
filterByBoolMask_16 = List.FilterByBoolMask(list=all_elements_of_category_8, mask=code_block_62)
python_script_15 = Python(IN[0]=filterByBoolMask_16.in)  # IronPython2; same code as python_script
code_block_63 = CodeBlock { 0.09290304; }
mul_8 = python_script_15 * code_block_63
code_block_64 = CodeBlock(x=mul_8) { x != ""? x : 0; }
sum_8 = Math.Sum(values=code_block_64)
python_script_16 = Python(IN[0]=sum_8)  # IronPython2; same code as python_script_2
setParameterByName_8 = Element.SetParameterByName(element=flatten_8, parameterName=code_block_59, value=python_script_16)

# group: TF
code_block_65 = CodeBlock { "pdeInfoBox"; }
byName_17 = FamilyType.ByName(name=code_block_65)
byFamilyType_9 = FamilyInstance.ByFamilyType(familyType=byName_17)
code_block_66 = CodeBlock { "ID"; }
getParameterValueByName_17 = Element.GetParameterValueByName(element=byFamilyType_9, parameterName=code_block_66)
string_9 = StringInput("490682")
eq_9 = getParameterValueByName_17 == string_9
filterByBoolMask_17 = List.FilterByBoolMask(list=byFamilyType_9, mask=eq_9)
flatten_9 = List.Flatten(list=filterByBoolMask_17.in)
code_block_67 = CodeBlock { "isValue"; }
code_block_68 = CodeBlock { "OST_Rooms"; }
byName_18 = Category.ByName(name=code_block_68)
all_elements_of_category_9 = ElementsOfCategory(Category=byName_18)
code_block_69 = CodeBlock { "MCI-HL-ÖNORM B1800 NRF"; }
getParameterValueByName_18 = Element.GetParameterValueByName(element=all_elements_of_category_9, parameterName=code_block_69)
code_block_70 = CodeBlock(x=getParameterValueByName_18) { x=="TF"? true: false; }
filterByBoolMask_18 = List.FilterByBoolMask(list=all_elements_of_category_9, mask=code_block_70)
python_script_17 = Python(IN[0]=filterByBoolMask_18.in)  # IronPython2; same code as python_script
code_block_71 = CodeBlock { 0.09290304; }
mul_9 = python_script_17 * code_block_71
code_block_72 = CodeBlock(x=mul_9) { x != ""? x : 0; }
sum_9 = Math.Sum(values=code_block_72)
python_script_18 = Python(IN[0]=sum_9)  # IronPython2; same code as python_script_2
setParameterByName_9 = Element.SetParameterByName(element=flatten_9, parameterName=code_block_67, value=python_script_18)

# group: SF
code_block_73 = CodeBlock { "pdeInfoBox"; }
byName_19 = FamilyType.ByName(name=code_block_73)
byFamilyType_10 = FamilyInstance.ByFamilyType(familyType=byName_19)
code_block_74 = CodeBlock { "ID"; }
getParameterValueByName_19 = Element.GetParameterValueByName(element=byFamilyType_10, parameterName=code_block_74)
string_10 = StringInput("515769")
eq_10 = getParameterValueByName_19 == string_10
filterByBoolMask_19 = List.FilterByBoolMask(list=byFamilyType_10, mask=eq_10)
flatten_10 = List.Flatten(list=filterByBoolMask_19.in)
code_block_75 = CodeBlock { "isValue"; }
code_block_76 = CodeBlock { "OST_Rooms"; }
byName_20 = Category.ByName(name=code_block_76)
all_elements_of_category_10 = ElementsOfCategory(Category=byName_20)
code_block_77 = CodeBlock { "MCI-HL-ÖNORM B1800 NRF"; }
getParameterValueByName_20 = Element.GetParameterValueByName(element=all_elements_of_category_10, parameterName=code_block_77)
code_block_78 = CodeBlock(x=getParameterValueByName_20) { x=="SF"? true: false; }
filterByBoolMask_20 = List.FilterByBoolMask(list=all_elements_of_category_10, mask=code_block_78)
python_script_19 = Python(IN[0]=filterByBoolMask_20.in)  # IronPython2; same code as python_script
code_block_79 = CodeBlock { 0.09290304; }
mul_10 = python_script_19 * code_block_79
code_block_80 = CodeBlock(x=mul_10) { x != ""? x : 0; }
sum_10 = Math.Sum(values=code_block_80)
python_script_20 = Python(IN[0]=sum_10)  # IronPython2; same code as python_script_2
setParameterByName_10 = Element.SetParameterByName(element=flatten_10, parameterName=code_block_75, value=python_script_20)

# group: VF
code_block_81 = CodeBlock { "pdeInfoBox"; }
byName_21 = FamilyType.ByName(name=code_block_81)
byFamilyType_11 = FamilyInstance.ByFamilyType(familyType=byName_21)
code_block_82 = CodeBlock { "ID"; }
getParameterValueByName_21 = Element.GetParameterValueByName(element=byFamilyType_11, parameterName=code_block_82)
string_11 = StringInput("445483")
eq_11 = getParameterValueByName_21 == string_11
filterByBoolMask_21 = List.FilterByBoolMask(list=byFamilyType_11, mask=eq_11)
flatten_11 = List.Flatten(list=filterByBoolMask_21.in)
code_block_83 = CodeBlock { "isValue"; }
code_block_84 = CodeBlock { "OST_Rooms"; }
byName_22 = Category.ByName(name=code_block_84)
all_elements_of_category_11 = ElementsOfCategory(Category=byName_22)
code_block_85 = CodeBlock { "MCI-HL-ÖNORM B1800 NRF"; }
getParameterValueByName_22 = Element.GetParameterValueByName(element=all_elements_of_category_11, parameterName=code_block_85)
code_block_86 = CodeBlock(x=getParameterValueByName_22) { x=="VF"? true: false; }
filterByBoolMask_22 = List.FilterByBoolMask(list=all_elements_of_category_11, mask=code_block_86)
python_script_21 = Python(IN[0]=filterByBoolMask_22.in)  # IronPython2; same code as python_script
code_block_87 = CodeBlock { 0.09290304; }
mul_11 = python_script_21 * code_block_87
code_block_88 = CodeBlock(x=mul_11) { x != ""? x : 0; }
sum_11 = Math.Sum(values=code_block_88)
python_script_22 = Python(IN[0]=sum_11)  # IronPython2; same code as python_script_2
setParameterByName_11 = Element.SetParameterByName(element=flatten_11, parameterName=code_block_83, value=python_script_22)

# group: ## Nicht angegeben
code_block_89 = CodeBlock { "pdeInfoBox"; }
byName_23 = FamilyType.ByName(name=code_block_89)
byFamilyType_12 = FamilyInstance.ByFamilyType(familyType=byName_23)
code_block_90 = CodeBlock { "ID"; }
getParameterValueByName_23 = Element.GetParameterValueByName(element=byFamilyType_12, parameterName=code_block_90)
string_12 = StringInput("836029")
eq_12 = getParameterValueByName_23 == string_12
filterByBoolMask_23 = List.FilterByBoolMask(list=byFamilyType_12, mask=eq_12)
flatten_12 = List.Flatten(list=filterByBoolMask_23.in)
code_block_91 = CodeBlock { "isValue"; }
code_block_92 = CodeBlock { "OST_Rooms"; }
byName_24 = Category.ByName(name=code_block_92)
all_elements_of_category_12 = ElementsOfCategory(Category=byName_24)
code_block_93 = CodeBlock { "MCI-HL-ÖNORM B1800 NRF"; }
getParameterValueByName_24 = Element.GetParameterValueByName(element=all_elements_of_category_12, parameterName=code_block_93)
code_block_94 = CodeBlock(x=getParameterValueByName_24) { x==""? true: false; }
filterByBoolMask_24 = List.FilterByBoolMask(list=all_elements_of_category_12, mask=code_block_94)
python_script_23 = Python(IN[0]=filterByBoolMask_24.in)  # IronPython2; same code as python_script
code_block_95 = CodeBlock { 0.09290304; }
mul_12 = python_script_23 * code_block_95
code_block_96 = CodeBlock(x=mul_12) { x != ""? x : 0; }
sum_12 = Math.Sum(values=code_block_96)
python_script_24 = Python(IN[0]=sum_12)  # IronPython2; same code as python_script_2
setParameterByName_12 = Element.SetParameterByName(element=flatten_12, parameterName=code_block_91, value=python_script_24)
