# Dynamo graph lastCheck.dyn (Dynamo 2.12.0.5650)

code_block = CodeBlock { "pdeInfoBox"; }
byName = FamilyType.ByName(name=code_block)
byFamilyType = FamilyInstance.ByFamilyType(familyType=byName)
code_block_2 = CodeBlock { "mustValue"; }
getParameterValueByName = Element.GetParameterValueByName(element=byFamilyType, parameterName=code_block_2)
code_block_3 = CodeBlock { ""; }
eq = getParameterValueByName == code_block_3
filterByBoolMask = List.FilterByBoolMask(list=byFamilyType, mask=eq)
watch = Watch(filterByBoolMask.out)
code_block_4 = CodeBlock { "mustValue"; }
getParameterValueByName_2 = Element.GetParameterValueByName(element=watch, parameterName=code_block_4)
code_block_5 = CodeBlock { "isValue"; }
getParameterValueByName_3 = Element.GetParameterValueByName(element=watch, parameterName=code_block_5)
eq_2 = getParameterValueByName_2 == getParameterValueByName_3
filterByBoolMask_2 = List.FilterByBoolMask(list=watch, mask=eq_2)
watch_2 = Watch(filterByBoolMask_2.out)
code_block_6 = CodeBlock { "autoColor"; }
code_block_7 = CodeBlock { -1; }
setParameterByName = Element.SetParameterByName(element=watch_2, parameterName=code_block_6, value=code_block_7)
watch_3 = Watch(filterByBoolMask_2.in)
code_block_8 = CodeBlock { "autoColor"; }
code_block_9 = CodeBlock { 0; }
setParameterByName_2 = Element.SetParameterByName(element=watch_3, parameterName=code_block_8, value=code_block_9)
