# Dynamo graph script.dyn "046" (Dynamo 2.6.1.8786)

code_block = CodeBlock { "Select an ImportInstance"; }
python_script = Python(IN[0]=code_block)
# ---------- python_script.python (26 lines) ----------
#dynre*
#tfjtpy
#selPickObject

import clr
clr.AddReference ( "RevitAPIUI" ) 
from Autodesk.Revit.UI import *

clr.AddReference( "RevitServices " ) 
import RevitServices 
from RevitServices.Persistence import DocumentManager 
doc = DocumentManager.Instance.CurrentDBDocument 
uidoc=DocumentManager.Instance.CurrentUIApplication.ActiveUIDocument 

clr.AddReference("RevitNodes") 
import Revit 
clr.ImportExtensions(Revit.Elements)

sel = uidoc.Selection
obType = Selection.ObjectType.Element
ref = sel.PickObject(obType, IN[0])
element = doc.GetElement(ref.ElementId)

OUT = element

#dynre*
# ----------------------------------------
id = Element.Id(element=python_script)
string_from_object = FromObject(obj=id)
string_from_object_2 = FromObject(obj=string_from_object)
python_script_2 = Python(IN[0]=string_from_object_2)
# ---------- python_script_2.python (24 lines) ----------
#dynre*
#enzrnt
#IsolatedPickModelElements

import clr

clr.AddReference("RevitAPIUI")
from  Autodesk.Revit.UI import *

clr.AddReference("RevitServices")
import RevitServices
from RevitServices.Persistence import DocumentManager
doc = DocumentManager.Instance.CurrentDBDocument
uidoc=DocumentManager.Instance.CurrentUIApplication.ActiveUIDocument

clr.AddReference("RevitNodes")
import Revit
clr.ImportExtensions(Revit.Elements)

soso = TaskDialog.Show('Get Element ID',( IN[0] + "\n" + "— Copied to clipboard" ))

OUT = "done"

#dynre*
# ----------------------------------------
python_script_3 = Python(IN[0]=string_from_object)
# ---------- python_script_3.python (7 lines) ----------
import os
def addToClipBoard(text):
    command = 'echo ' + text.strip() + '| clip'
    os.system(command)
    
    
addToClipBoard(IN[0])
# ----------------------------------------
