# Dynamo graph script.dyn "CountHiddenElementsInView" (Dynamo 2.12.0.5650)

refresh = BoolSelector(false)
get_hidden_elements_ids = Python(IN[0]=refresh)  # IronPython2
# ---------- get_hidden_elements_ids.python (30 lines) ----------
import clr
clr.AddReference('ProtoGeometry')
from Autodesk.DesignScript.Geometry import *
# Import ToDSType(bool) extension method
clr.AddReference("RevitNodes")
import Revit
clr.ImportExtensions(Revit.Elements)
# Import geometry conversion extension methods
clr.ImportExtensions(Revit.GeometryConversion)
# Import DocumentManager and TransactionManager
clr.AddReference("RevitServices")
import RevitServices
from RevitServices.Persistence import DocumentManager
from RevitServices.Transactions import TransactionManager
from System.Collections.Generic import *
# Import RevitAPI
clr.AddReference("RevitAPI")
import Autodesk
from Autodesk.Revit.DB import *
from Autodesk.Revit.DB.Architecture import *

doc = DocumentManager.Instance.CurrentDBDocument
view = doc.ActiveView
hiddenIds = List[ElementId]()

for elem in FilteredElementCollector(doc).WhereElementIsNotElementType():
	if elem.IsHidden(view):
		hiddenIds.Add(elem.Id)
		
OUT = hiddenIds
# ----------------------------------------
count = List.Count(list=get_hidden_elements_ids)
toString = Python(IN[0]=count)  # IronPython2
# ---------- toString.python (18 lines) ----------
import clr

def tolist(obj1):
	if hasattr(obj1,"__iter__"): return obj1
	else: return [obj1]

def output1(l1):
	if len(l1) == 1: return l1[0]
	else: return l1

num1 = tolist(IN[0])
out1 = []
for i in xrange(len(num1)):
	s1 = str(num1[i])
	if s1[-2:] == ".0": out1.append(s1[:-2])
	else: out1.append(s1)

OUT = output1(out1)
# ----------------------------------------
code_block = CodeBlock(a=toString) { "(" + a + ") Elemente sind in dieser Ansicht ausgeblendet."; }
python_script = Python(IN[0]=code_block)  # IronPython2
# ---------- python_script.python (9 lines) ----------
import clr
import msvcrt

clr.AddReference("RevitAPIUI")
from  Autodesk.Revit.UI import *

TaskDialog.Show('Anzahl ausgeblendeter Elemente',IN[0])
		
OUT = IN[0]
# ----------------------------------------
