# Dynamo graph countCADIn2D.dyn (Dynamo 2.10.1.3976)

python_script = Python()  # IronPython2; unwired: IN[0]
# ---------- python_script.python (45 lines) ----------
#dynre*
#otrleq
#GetAllImportInstancesOfDWGs

import clr

clr.AddReference('ProtoGeometry')
from Autodesk.DesignScript.Geometry import *

#Import the Revit API
clr.AddReference('RevitAPI')
import Autodesk
from Autodesk.Revit.DB import *

#Import DocumentManager and TransactionManager
clr.AddReference('RevitServices')
import RevitServices
from RevitServices.Persistence import DocumentManager
from RevitServices.Transactions import TransactionManager

#Import ToDSType(bool) extensions method
clr.AddReference('RevitNodes')
import Revit
clr.ImportExtensions(Revit.Elements)

#Reference the active Document and application
doc = DocumentManager.Instance.CurrentDBDocument
uiapp = DocumentManager.Instance.CurrentUIApplication
app = uiapp.Application

#Start scripting here:

col = FilteredElementCollector(doc).OfClass(ImportInstance).ToElements()
impinst = []
impname = []

for i in col:
	impinst.append(i)
		
for j in impinst:
	impname.append(j.Category.Name)
			
OUT = impinst, impname

#dynre*
# ----------------------------------------
code_block = CodeBlock(x=python_script) { x[0]; }
code_block_2 = CodeBlock(t1=code_block)
# ---------- code_block_2.designscript (3 lines) ----------
parameter1 = Revit.Elements.Element.Parameters(t1);
num2 = Revit.Elements.Parameter.Id(parameter1);
bool1 = List.Contains(num2@L2<1>, -1007703);
# ----------------------------------------
countFalse = List.CountFalse(list=code_block_2.bool1)
toString = Python(IN[0]=countFalse)  # IronPython2
# ---------- toString.python (1 lines) ----------
OUT = str(IN[0])
# ----------------------------------------
code_block_3 = CodeBlock(input=toString)
# ---------- code_block_3.designscript (8 lines) ----------
familytype = FamilyType.ByName("pdeInfoBox");
familyinstance = Revit.FamilyInstance.ByFamilyType(familytype);
id = "countCADIn2D";
a = Revit.Elements.Element.GetParameterValueByName(familyinstance, "ID");
t1 = ((a == id ? true : false));
t4 = List.FilterByBoolMask(familyinstance, t1);
t5 = DesignScript.Dictionary.ValueAtKey(t4, "in");
Revit.Elements.Element.SetParameterByName(t5, "isValue", input);
# ----------------------------------------
code_block_4 = CodeBlock(x=code_block_3.out7)
# ---------- code_block_4.designscript (2 lines) ----------
element = ((List.IsEmpty(x) ? false : x));
Revit.Elements.Element.SetParameterByName(element, "lastUpdate", (DateTime.Now+""));
# ----------------------------------------
