# Dynamo graph countInPlaceFamilies.dyn (Dynamo 2.10.1.3976)

getAllFamilies = Python()  # IronPython2; unwired: IN[0]
# ---------- getAllFamilies.python (21 lines) ----------
import clr
clr.AddReference('ProtoGeometry')
from Autodesk.DesignScript.Geometry import *

# Import DocumentManager and TransactionManager
clr.AddReference("RevitServices")
import RevitServices
from RevitServices.Persistence import DocumentManager
from RevitServices.Transactions import TransactionManager
from System.Collections.Generic import *
#
# Import RevitAPI
clr.AddReference("RevitAPI")
import Autodesk
from Autodesk.Revit.DB import *

doc = DocumentManager.Instance.CurrentDBDocument
uiapp = DocumentManager.Instance.CurrentUIApplication
app = uiapp.Application

OUT = FilteredElementCollector(doc).OfClass(Family).ToElements()
# ----------------------------------------
python_script = Python(IN[0]=getAllFamilies)  # IronPython2
# ---------- python_script.python (13 lines) ----------
import clr
import System
clr.AddReference('RevitAPI')
from Autodesk.Revit.DB import *

def IsInPlace(item):
	if hasattr(item, "IsInPlace"): return item.IsInPlace
	else: return None

items = UnwrapElement(IN[0])

if isinstance(IN[0], list): OUT = [IsInPlace(x) for x in items]
else: OUT = IsInPlace(items)
# ----------------------------------------
countTrue = List.CountTrue(list=python_script)
toString = Python(IN[0]=countTrue)  # IronPython2
# ---------- toString.python (1 lines) ----------
OUT = str(IN[0])
# ----------------------------------------
code_block = CodeBlock(input=toString)
# ---------- code_block.designscript (8 lines) ----------
familytype = FamilyType.ByName("pdeInfoBox");
familyinstance = Revit.FamilyInstance.ByFamilyType(familytype);
id = "countInPlaceFamilies";
a = Revit.Elements.Element.GetParameterValueByName(familyinstance, "ID");
t1 = ((a == id ? true : false));
t4 = List.FilterByBoolMask(familyinstance, t1);
t5 = DesignScript.Dictionary.ValueAtKey(t4, "in");
Revit.Elements.Element.SetParameterByName(t5, "isValue", input);
# ----------------------------------------
code_block_2 = CodeBlock(x=code_block.out7)
# ---------- code_block_2.designscript (2 lines) ----------
element = ((List.IsEmpty(x) ? false : x));
Revit.Elements.Element.SetParameterByName(element, "lastUpdate", (DateTime.Now+""));
# ----------------------------------------
