# Dynamo graph countNotPinnedRVTLinks.dyn (Dynamo 2.10.1.3976)

code_block = CodeBlock { "OST_RvtLinks"; }
byName = Category.ByName(name=code_block)
all_elements_of_category = ElementsOfCategory(Category=byName)
isPinned = Element.IsPinned(element=all_elements_of_category)
countFalse = List.CountFalse(list=isPinned)
toString = Python(IN[0]=countFalse)  # IronPython2
# ---------- toString.python (1 lines) ----------
OUT = str(IN[0])
# ----------------------------------------
code_block_2 = CodeBlock(input=toString)
# ---------- code_block_2.designscript (8 lines) ----------
familytype = FamilyType.ByName("pdeInfoBox");
familyinstance = Revit.FamilyInstance.ByFamilyType(familytype);
id = "countNotPinnedRVTLinks";
a = Revit.Elements.Element.GetParameterValueByName(familyinstance, "ID");
t1 = ((a == id ? true : false));
t4 = List.FilterByBoolMask(familyinstance, t1);
t5 = DesignScript.Dictionary.ValueAtKey(t4, "in");
Revit.Elements.Element.SetParameterByName(t5, "isValue", input);
# ----------------------------------------
code_block_3 = CodeBlock(x=code_block_2.out7)
# ---------- code_block_3.designscript (2 lines) ----------
element = ((List.IsEmpty(x) ? false : x));
Revit.Elements.Element.SetParameterByName(element, "lastUpdate", (DateTime.Now+""));
# ----------------------------------------
