# Dynamo graph countRoomsNotOnFOK.dyn (Dynamo 2.10.1.3976)

code_block = CodeBlock { "ROOM_LEVEL_ID"; }
code_block_2 = CodeBlock { "OST_Rooms"; }
byName = Category.ByName(name=code_block_2)
all_elements_of_category = ElementsOfCategory(Category=byName)
getParameterValueByBuiltInParameterName = Python(IN[0]=code_block, IN[1]=all_elements_of_category)  # IronPython2
# ---------- getParameterValueByBuiltInParameterName.python (112 lines) ----------
#dynre*
#zoeleq
#GetBuiltInParameterValueByElement

import clr
import sys
clr.AddReference('ProtoGeometry')
from Autodesk.DesignScript.Geometry import *

pyt_path = r'C:\Program Files (x86)\IronPython 2.7\Lib'
sys.path.append(pyt_path)

# Import Element wrapper extension methods
clr.AddReference("RevitNodes")
import Revit
clr.ImportExtensions(Revit.Elements)

# Import DocumentManager and TransactionManager
clr.AddReference("RevitServices")
import RevitServices
from RevitServices.Persistence import DocumentManager
from RevitServices.Transactions import TransactionManager

doc = DocumentManager.Instance.CurrentDBDocument
uiapp = DocumentManager.Instance.CurrentUIApplication
app = uiapp.Application

# Import RevitAPI
clr.AddReference("RevitAPI")
import Autodesk
from Autodesk.Revit.DB import *
import System

#The inputs to this node will be stored as a list in the IN variable.
dataEnteringNode = IN

paramNames = IN[0]

if isinstance(IN[1], list):
	sheets = []
	for i in IN[1]:
		sheets.append(UnwrapElement(i))
else:
	sheets = IN[1]

elements = []
for i in sheets:
	elements.append(UnwrapElement(i))

def ProcessList(_func, _list):
    return map( lambda x: ProcessList(_func, x) if type(x)==list else _func(x), _list )

def ProcessListArg(_func, _list, _arg):
    return map( lambda x: ProcessListArg(_func, x, _arg) if type(x)==list else _func(x, _arg), _list )

def GetBuiltInParam(paramName):
	builtInParams = System.Enum.GetValues(BuiltInParameter)
	test = []
	for i in builtInParams:
		if i.ToString() == paramName:
			test.append(i)
			break
		else:
			continue
	return test[0]

def GetBipValue(element, bip):
	doc = DocumentManager.Instance.CurrentDBDocument
	value = None
	try:
		tempValue = element.get_Parameter(bip)
	except:
		tempValue = None
		pass
	if tempValue != None and tempValue.HasValue:
		if element.get_Parameter(bip).StorageType == StorageType.String:
			value = element.get_Parameter(bip).AsString()
		elif element.get_Parameter(bip).StorageType == StorageType.Integer:
			value  = element.get_Parameter(bip).AsInteger()
		elif element.get_Parameter(bip).StorageType == StorageType.Double:
			value = element.get_Parameter(bip).AsDouble()
		elif element.get_Parameter(bip).StorageType == StorageType.ElementId:
			id = element.get_Parameter(bip).AsElementId()
			value = doc.GetElement(id)
		return value
	else:
		return None

try:
	errorReport = None
	paramValues = []
	if isinstance(paramNames, list):
		builtInParams = ProcessList(GetBuiltInParam, paramNames)
		for i in builtInParams:
			paramValues.append(ProcessListArg(GetBipValue, elements, i))
	else:
		builtInParams = GetBuiltInParam(paramNames)
		if isinstance(sheets, list):
			for sheet in sheets:
				paramValues.append(GetBipValue(sheet, builtInParams))
except:
	# if error accurs anywhere in the process catch it
	import traceback
	errorReport = traceback.format_exc()

#Assign your output to the OUT variable
if errorReport == None:
	OUT = paramValues
else:
	OUT = errorReport

#dynre*
# ----------------------------------------
clean = Python(IN[0]=getParameterValueByBuiltInParameterName)  # IronPython2
# ---------- clean.python (17 lines) ----------
#https://stackoverflow.com/questions/30488751/clean-list-or-list-of-lists-of-all-none-or-empty-lists-in-python

def ClearList(primList):
    result = []
    for sublist in primList:
        if sublist is "":
            continue
        elif sublist is None:
            continue 
        if isinstance(sublist, list):
             sublist = ClearList(sublist)
             if not sublist:
                 continue
        result.append(sublist)
    return result

OUT = ClearList(IN[0])
# ----------------------------------------
elementType = Element.ElementType(element=clean)
name = Element.Name(element=elementType)
code_block_3 = CodeBlock(a=name) { a != "FBOK"; }
countTrue = List.CountTrue(list=code_block_3)
toString = Python(IN[0]=countTrue)  # IronPython2
# ---------- toString.python (1 lines) ----------
OUT = str(IN[0])
# ----------------------------------------
code_block_4 = CodeBlock(input=toString)
# ---------- code_block_4.designscript (8 lines) ----------
familytype = FamilyType.ByName("pdeInfoBox");
familyinstance = Revit.FamilyInstance.ByFamilyType(familytype);
id = "countRoomsNotOnFOK";
a = Revit.Elements.Element.GetParameterValueByName(familyinstance, "ID");
t1 = ((a == id ? true : false));
t4 = List.FilterByBoolMask(familyinstance, t1);
t5 = DesignScript.Dictionary.ValueAtKey(t4, "in");
Revit.Elements.Element.SetParameterByName(t5, "isValue", input);
# ----------------------------------------
code_block_5 = CodeBlock(x=code_block_4.out7)
# ---------- code_block_5.designscript (2 lines) ----------
element = ((List.IsEmpty(x) ? false : x));
Revit.Elements.Element.SetParameterByName(element, "lastUpdate", (DateTime.Now+""));
# ----------------------------------------
