# Dynamo graph countViewTemplates.dyn (Dynamo 2.10.1.3976)

python_script = Python()  # IronPython2; unwired: IN[0]
# ---------- python_script.python (22 lines) ----------
import clr
clr.AddReference('ProtoGeometry')
from Autodesk.DesignScript.Geometry import *
clr.AddReference('RevitAPI')
from Autodesk.Revit.DB import *
import Autodesk
clr.AddReference('RevitServices')
from RevitServices.Persistence import *
import RevitServices
#The inputs to this node will be stored as a list in the IN variables.
dataEnteringNode = IN

doc = DocumentManager.Instance.CurrentDBDocument
views = FilteredElementCollector(doc).OfClass(View)
viewlist = list()

for view in views:
	if view.IsTemplate == True:
		viewlist.append(view)

#Assign your output to the OUT variable.
OUT = viewlist
# ----------------------------------------
clean = Python(IN[0]=python_script)  # "List.Clean"; IronPython2
# ---------- clean.python (23 lines) ----------
#Copyright(c) 2015, Konrad K Sobon
# @arch_laboratory, http://archi-lab.net

import clr
clr.AddReference('ProtoGeometry')
from Autodesk.DesignScript.Geometry import *
#The inputs to this node will be stored as a list in the IN variable.
dataEnteringNode = IN

def ClearList(_list):
    out = []
    for _list1 in _list:
        if _list1 is None:
            continue
        if isinstance(_list1, list):
             _list1 = ClearList(_list1)
             if not _list1:
                 continue
        out.append(_list1)
    return out

#Assign your output to the OUT variable
OUT = ClearList(IN[0])
# ----------------------------------------
count = List.Count(list=clean)
toString = Python(IN[0]=count)  # IronPython2
# ---------- toString.python (1 lines) ----------
OUT = str(IN[0])
# ----------------------------------------
code_block = CodeBlock(input=toString)
# ---------- code_block.designscript (8 lines) ----------
familytype = FamilyType.ByName("pdeInfoBox");
familyinstance = Revit.FamilyInstance.ByFamilyType(familytype);
id = "countViewTemplates";
a = Revit.Elements.Element.GetParameterValueByName(familyinstance, "ID");
t1 = ((a == id ? true : false));
t4 = List.FilterByBoolMask(familyinstance, t1);
t5 = DesignScript.Dictionary.ValueAtKey(t4, "in");
Revit.Elements.Element.SetParameterByName(t5, "isValue", input);
# ----------------------------------------
code_block_2 = CodeBlock(x=code_block.out7)
# ---------- code_block_2.designscript (2 lines) ----------
element = ((List.IsEmpty(x) ? false : x));
Revit.Elements.Element.SetParameterByName(element, "lastUpdate", (DateTime.Now+""));
# ----------------------------------------
