# Dynamo graph countWarnings.dyn (Dynamo 2.10.1.3976)

current = Document.Current()
getWarnings = Warning.GetWarnings(document=current)
count = List.Count(list=getWarnings)
toString = Python(IN[0]=count)  # IronPython2
# ---------- toString.python (1 lines) ----------
OUT = str(IN[0])
# ----------------------------------------
code_block = CodeBlock(input=toString)
# ---------- code_block.designscript (8 lines) ----------
familytype = FamilyType.ByName("pdeInfoBox");
familyinstance = Revit.FamilyInstance.ByFamilyType(familytype);
id = "countWarnings";
a = Revit.Elements.Element.GetParameterValueByName(familyinstance, "ID");
t1 = ((a == id ? true : false));
t4 = List.FilterByBoolMask(familyinstance, t1);
t5 = DesignScript.Dictionary.ValueAtKey(t4, "in");
Revit.Elements.Element.SetParameterByName(t5, "isValue", input);
# ----------------------------------------
code_block_2 = CodeBlock(x=code_block.out7)
# ---------- code_block_2.designscript (2 lines) ----------
element = ((List.IsEmpty(x) ? false : x));
Revit.Elements.Element.SetParameterByName(element, "lastUpdate", (DateTime.Now+""));
# ----------------------------------------
