# Dynamo graph countWindowsNotOnFOK.dyn (Dynamo 2.10.1.3976)

code_block = CodeBlock { "OST_Windows"; }
byName = Category.ByName(name=code_block)
all_elements_of_category = ElementsOfCategory(Category=byName)
level = Python(IN[0]=all_elements_of_category)  # "Element.Level"; IronPython2
# ---------- level.python (42 lines) ----------
import clr
clr.AddReference('RevitAPI')
from Autodesk.Revit.DB import *

clr.AddReference("RevitNodes")
import Revit
clr.ImportExtensions(Revit.Elements)

def GetLevel(item):
	val = None
	if item:
		if hasattr(item, "LevelId"): 
			val = item.Document.GetElement(item.LevelId)
			if val: return val
		if hasattr(item, "Level"):
			val = item.Level
			if val: return val
		if hasattr(item, "GenLevel"):
			val = item.GenLevel
			if val: return val
		if (item.GetType().ToString() in ("Autodesk.Revit.DB.Architecture.StairsRun", "Autodesk.Revit.DB.Architecture.StairsLanding")):
			item = item.GetStairs()
		if (item.GetType().ToString() == "Autodesk.Revit.DB.Architecture.Stairs"):
			try: return item.Document.GetElement(item.get_Parameter(BuiltInParameter.STAIRS_BASE_LEVEL_PARAM).AsElementId())
			except: pass
		if (item.GetType().ToString() == "Autodesk.Revit.DB.ExtrusionRoof"):
			try: return item.Document.GetElement(item.get_Parameter(BuiltInParameter.ROOF_CONSTRAINT_LEVEL_PARAM).AsElementId())
			except: pass
		if not val:
			try: return item.Document.GetElement(item.get_Parameter(BuiltInParameter.INSTANCE_REFERENCE_LEVEL_PARAM).AsElementId())
			except: 
				try: return item.Document.GetElement(item.get_Parameter(BuiltInParameter.INSTANCE_SCHEDULE_ONLY_LEVEL_PARAM).AsElementId())
				except: 
					try: return item.Document.GetElement(item.get_Parameter(BuiltInParameter.SCHEDULE_LEVEL_PARAM).AsElementId())
					except: return None
		else: return None
	else: return None

items = UnwrapElement(IN[0])

if isinstance(IN[0], list): OUT = [GetLevel(x) for x in items]
else: OUT = GetLevel(items)
# ----------------------------------------
clean = Python(IN[0]=level)  # IronPython2
# ---------- clean.python (17 lines) ----------
#https://stackoverflow.com/questions/30488751/clean-list-or-list-of-lists-of-all-none-or-empty-lists-in-python

def ClearList(primList):
    result = []
    for sublist in primList:
        if sublist is "":
            continue
        elif sublist is None:
            continue 
        if isinstance(sublist, list):
             sublist = ClearList(sublist)
             if not sublist:
                 continue
        result.append(sublist)
    return result

OUT = ClearList(IN[0])
# ----------------------------------------
elementType = Element.ElementType(element=clean)
name = Element.Name(element=elementType)
code_block_2 = CodeBlock(a=name) { a != "FBOK"; }
countTrue = List.CountTrue(list=code_block_2)
toString = Python(IN[0]=countTrue)  # IronPython2
# ---------- toString.python (1 lines) ----------
OUT = str(IN[0])
# ----------------------------------------
code_block_3 = CodeBlock(input=toString)
# ---------- code_block_3.designscript (8 lines) ----------
familytype = FamilyType.ByName("pdeInfoBox");
familyinstance = Revit.FamilyInstance.ByFamilyType(familytype);
id = "countWindowsNotOnFOK";
a = Revit.Elements.Element.GetParameterValueByName(familyinstance, "ID");
t1 = ((a == id ? true : false));
t4 = List.FilterByBoolMask(familyinstance, t1);
t5 = DesignScript.Dictionary.ValueAtKey(t4, "in");
Revit.Elements.Element.SetParameterByName(t5, "isValue", input);
# ----------------------------------------
code_block_4 = CodeBlock(x=code_block_3.out7)
# ---------- code_block_4.designscript (2 lines) ----------
element = ((List.IsEmpty(x) ? false : x));
Revit.Elements.Element.SetParameterByName(element, "lastUpdate", (DateTime.Now+""));
# ----------------------------------------
