# Dynamo graph countWrongPlacedRVTLinks.dyn (Dynamo 2.10.1.3976)

code_block = CodeBlock { "OST_RvtLinks"; }
byName = Category.ByName(name=code_block)
all_elements_of_category = ElementsOfCategory(Category=byName)
code_block_2 = CodeBlock { "OST_ProjectBasePoint"; }
byName_2 = Category.ByName(name=code_block_2)
python_script = Python(IN[0]=all_elements_of_category, IN[1]=byName_2)  # IronPython2; unwired: IN[2]
# ---------- python_script.python (71 lines) ----------
# Copyright(c) 2019, Dimitar Venkov
# @5devene, dimitar.ven@gmail.com
# www.badmonkeys.net

import clr

clr.AddReference("RevitNodes")
import Revit
clr.ImportExtensions(Revit.Elements)
clr.ImportExtensions(Revit.GeometryConversion)

clr.AddReference('RevitServices')
from RevitServices.Persistence import DocumentManager
doc = DocumentManager.Instance.CurrentDBDocument

clr.AddReference("RevitAPI")
from Autodesk.Revit.DB import FilteredElementCollector, RevitLinkType, ElementMulticategoryFilter, ElementId
import Autodesk.Revit.DB as DB

from System.Collections.Generic import List
import System

def tolist(obj1):
	if hasattr(obj1,"__iter__"): return obj1
	else: return [obj1]

links = UnwrapElement(tolist(IN[0]) )
cats = UnwrapElement(tolist(IN[1]) )
elements, transforms = [], []
OUT = elements, transforms

ueWrapper = None
wrappers = clr.GetClrType(Revit.Elements.ElementWrapper).GetMethods()
for w in wrappers:
	if w.ToString().startswith("Revit.Elements.UnknownElement"):
		ueWrapper = w
		break

for link in links:
	try:
		if RevitLinkType.IsLoaded(doc, link.GetTypeId() ):
			linkDoc = link.GetLinkDocument()
			
			if isinstance(cats[0], DB.Category):
				catId = List[DB.ElementId](c.Id for c in cats)
				filter = DB.ElementMulticategoryFilter(catId)
			elif isinstance(cats[0], DB.ElementType):
				types = List[System.Type](t.GetType() for t in cats)
				filter = DB.ElementMulticlassFilter(types)
			else:
				types = List[System.Type](cats)
				filter = DB.ElementMulticlassFilter(types)
			
			fec = FilteredElementCollector(linkDoc).WhereElementIsNotElementType().WherePasses(filter)
			linkEls = []
			for e in fec:
				try:
					linkEls.append(e.ToDSType(True) )
				except:
					if ueWrapper:
						linkEls.append(ueWrapper.Invoke(None, (e, True) ) )
			elements.append(linkEls)
			transforms.append(link.GetTotalTransform().ToCoordinateSystem(1) )
			fec.Dispose()
			filter.Dispose()
		else:
			elements.append('Linked document is unloaded')
			transforms.append(None)
	except Exception, ex:
		elements.append(str(ex) )
		transforms.append(None)
# ----------------------------------------
code_block_3 = CodeBlock(res=python_script) { res[0]; res[1]; }
origin = CoordinateSystem.Origin(coordinateSystem=code_block_3.out1)
code_block_4 = CodeBlock { 0; }
byCoordinates = Point.ByCoordinates(x=code_block_4, y=code_block_4, z=code_block_4)
doesIntersect = Geometry.DoesIntersect(geometry=origin, other=byCoordinates)
countFalse = List.CountFalse(list=doesIntersect)
toString = Python(IN[0]=countFalse)  # IronPython2
# ---------- toString.python (1 lines) ----------
OUT = str(IN[0])
# ----------------------------------------
code_block_5 = CodeBlock(input=toString)
# ---------- code_block_5.designscript (8 lines) ----------
familytype = FamilyType.ByName("pdeInfoBox");
familyinstance = Revit.FamilyInstance.ByFamilyType(familytype);
id = "countWrongPlacedRVTLinks";
a = Revit.Elements.Element.GetParameterValueByName(familyinstance, "ID");
t1 = ((a == id ? true : false));
t4 = List.FilterByBoolMask(familyinstance, t1);
t5 = DesignScript.Dictionary.ValueAtKey(t4, "in");
Revit.Elements.Element.SetParameterByName(t5, "isValue", input);
# ----------------------------------------
code_block_6 = CodeBlock(x=code_block_5.out7)
# ---------- code_block_6.designscript (2 lines) ----------
element = ((List.IsEmpty(x) ? false : x));
Revit.Elements.Element.SetParameterByName(element, "lastUpdate", (DateTime.Now+""));
# ----------------------------------------
