# Dynamo graph listPurgeableElements.dyn (Dynamo 2.10.1.3976)

code_block = CodeBlock { "\n"; }
purgable_elements = Python()  # IronPython2; unwired: IN[0]
# ---------- purgable_elements.python (36 lines) ----------
import clr
import System
from System.Collections.Generic import List

clr.AddReference("RevitAPI")
import Autodesk
from Autodesk.Revit.DB import *

clr.AddReference("RevitServices")
import RevitServices
from RevitServices.Persistence import DocumentManager
from RevitServices.Transactions import TransactionManager

doc = DocumentManager.Instance.CurrentDBDocument

#GetPurgeableElements by Oliver E Green 
def GetPurgeableElements(doc, rule_id_list):
	failure_messages = PerformanceAdviser.GetPerformanceAdviser().ExecuteRules(doc, rule_id_list)
	if failure_messages.Count > 0:
		purgeable_element_ids = failure_messages[0].GetFailingElements()
		return purgeable_element_ids

#A constant 
PURGE_GUID = "e8c63650-70b7-435a-9010-ec97660c1bda"

#A generic list of PerformanceAdviserRuleIds as required by the ExecuteRules method
rule_id_list = List[PerformanceAdviserRuleId]()

#Iterating through all PerformanceAdviser rules looking to find that which matches PURGE_GUID
for rule_id in PerformanceAdviser.GetPerformanceAdviser().GetAllRuleIds():
	if str(rule_id.Guid) == PURGE_GUID:
		rule_id_list.Add(rule_id)
		break

#Attempting to retrieve the elements which can be purged
OUT = GetPurgeableElements(doc, rule_id_list)
# ----------------------------------------
element_by_id = ElementById(Id=purgable_elements)
getCategory = Element.GetCategory(element=element_by_id)
list_clean = Python(IN[0]=getCategory)  # IronPython2
# ---------- list_clean.python (15 lines) ----------
def ClearList(primList):
    result = []
    for sublist in primList:
        if sublist is "":
            continue
        elif sublist is None:
            continue 
        if isinstance(sublist, list):
             sublist = ClearList(sublist)
             if not sublist:
                 continue
        result.append(sublist)
    return result

OUT = ClearList(IN[0])
# ----------------------------------------
groupByKey = List.GroupByKey(list=list_clean, keys=list_clean)
code_block_2 = CodeBlock { 0; }
getItemAtIndex = List.GetItemAtIndex(list=groupByKey.groups@L2, index=code_block_2)
count = List.Count(list=groupByKey.groups@L2)
sortByKey = List.SortByKey(list=getItemAtIndex, keys=count)
code_block_3 = CodeBlock(a=sortByKey.sortedKeys, b=sortByKey.sortedList) { "(" + a +")" +" " + b; }
join = String.Join(separator=code_block, string0=code_block_3)
code_block_4 = CodeBlock(input=join)
# ---------- code_block_4.designscript (8 lines) ----------
familytype = FamilyType.ByName("pdeInfoBox");
familyinstance = Revit.FamilyInstance.ByFamilyType(familytype);
id = "listPurgeableElements";
a = Revit.Elements.Element.GetParameterValueByName(familyinstance, "ID");
t1 = ((a == id ? true : false));
t4 = List.FilterByBoolMask(familyinstance, t1);
t5 = DesignScript.Dictionary.ValueAtKey(t4, "in");
Revit.Elements.Element.SetParameterByName(t5, "isValue", input);
# ----------------------------------------
code_block_5 = CodeBlock(x=code_block_4.out7)
# ---------- code_block_5.designscript (2 lines) ----------
element = ((List.IsEmpty(x) ? false : x));
Revit.Elements.Element.SetParameterByName(element, "lastUpdate", (DateTime.Now+""));
# ----------------------------------------
