# Dynamo graph listWarnings.dyn (Dynamo 2.10.1.3976)

current = Document.Current()
getWarnings = Warning.GetWarnings(document=current)
description = Warning.Description(warning=getWarnings)
groupByKey = List.GroupByKey(list=description, keys=description)
count = List.Count(list=groupByKey.groups@L2)
code_block = CodeBlock(a=count, b=groupByKey.unique_keys) { "• (" + a + ") " + b; }
sortByKey = List.SortByKey(list=code_block, keys=count)
watch = Watch(sortByKey.sortedList)
toMultiline = Python(IN[0]=watch)  # "List.ToMultiline"; IronPython2
# ---------- toMultiline.python (11 lines) ----------
text = IN[0]
newText = []

#add newline to the string
for t in text[:-1]:
	newText.append(t+'\n')

#add last line without newline
newText.append(text[-1])

OUT = ''.join(map(str, newText))
# ----------------------------------------
code_block_2 = CodeBlock(input=toMultiline)
# ---------- code_block_2.designscript (8 lines) ----------
familytype = FamilyType.ByName("pdeInfoBox");
familyinstance = Revit.FamilyInstance.ByFamilyType(familytype);
id = "listWarnings";
a = Revit.Elements.Element.GetParameterValueByName(familyinstance, "ID");
t1 = ((a == id ? true : false));
t4 = List.FilterByBoolMask(familyinstance, t1);
t5 = DesignScript.Dictionary.ValueAtKey(t4, "in");
Revit.Elements.Element.SetParameterByName(t5, "isValue", input);
# ----------------------------------------
code_block_3 = CodeBlock(x=code_block_2.out7)
# ---------- code_block_3.designscript (2 lines) ----------
element = ((List.IsEmpty(x) ? false : x));
Revit.Elements.Element.SetParameterByName(element, "lastUpdate", (DateTime.Now+""));
# ----------------------------------------
