# Dynamo graph projectSurveyPoint.dyn (Dynamo 2.10.1.3976)

get_project_origin_basepoint_and = Python()  # "Get Project Origin, BasePoint and SurveyPoint"; IronPython2; unwired: IN[0]
# ---------- get_project_origin_basepoint_and.python (62 lines) ----------
#Alban de Chasteigner 2018
#twitter : @geniusloci_bim
#geniusloci.bim@gmail.com
#https://github.com/albandechasteigner/GeniusLociForDynamo

import clr
import math
clr.AddReference("RevitServices")
import RevitServices 
from RevitServices.Persistence import DocumentManager
uiapp = DocumentManager.Instance.CurrentUIApplication
app = uiapp.Application
version=int(app.VersionNumber)

clr.AddReference("RevitNodes")
import Revit
clr.ImportExtensions(Revit.GeometryConversion)

clr.AddReference("RevitAPI")
import Autodesk
from Autodesk.Revit.DB import *

inputdoc = UnwrapElement(IN[0]) if isinstance(IN[0],list) else [UnwrapElement(IN[0])]

doc = DocumentManager.Instance.CurrentDBDocument

if version < 2021:
	angleUnit = doc.GetUnits().GetFormatOptions(UnitType.UT_Angle).DisplayUnits
else:
	angleUnit = doc.GetUnits().GetFormatOptions(SpecTypeId.Angle).GetUnitTypeId()

outProjBasePt, outProjSurvPt, outProjLoc = [],[],[]

pbp = FilteredElementCollector(doc).OfCategory(BuiltInCategory.OST_ProjectBasePoint).ToElements()
sbp = FilteredElementCollector(doc).OfCategory(BuiltInCategory.OST_SharedBasePoint).ToElements()

if version < 2018:
	projPos = doc.ActiveProjectLocation.get_ProjectPosition(XYZ(0,0,0))
else :
	projPos = doc.ActiveProjectLocation.GetProjectPosition(XYZ(0,0,0))
	
if version > 2019 and inputdoc != None :
	outProjBasePt = [pbp[0].SharedPosition.ToPoint(),abs(360-(round(Autodesk.Revit.DB.UnitUtils.ConvertFromInternalUnits(projPos.Angle,angleUnit),6)))]
	outProjSurvPt = sbp[0].SharedPosition.ToPoint()
else :
	pbpEW = pbp[0].get_Parameter(BuiltInParameter.BASEPOINT_EASTWEST_PARAM).AsDouble()
	pbpNS = pbp[0].get_Parameter(BuiltInParameter.BASEPOINT_NORTHSOUTH_PARAM).AsDouble()
	pbpElev = pbp[0].get_Parameter(BuiltInParameter.BASEPOINT_ELEVATION_PARAM).AsDouble()
	pbpAngle = pbp[0].get_Parameter(BuiltInParameter.BASEPOINT_ANGLETON_PARAM).AsDouble()*180/math.pi    
	outProjBasePt=[(XYZ(pbpEW,pbpNS,pbpElev)).ToPoint(),round(pbpAngle,6)]

	pspEW = sbp[0].get_Parameter(BuiltInParameter.BASEPOINT_EASTWEST_PARAM).AsDouble()
	pspNS = sbp[0].get_Parameter(BuiltInParameter.BASEPOINT_NORTHSOUTH_PARAM).AsDouble()
	pspElev = sbp[0].get_Parameter(BuiltInParameter.BASEPOINT_ELEVATION_PARAM).AsDouble()
	outProjSurvPt = XYZ(pspEW,pspNS,pspElev).ToPoint()
    	
if projPos == None:
	outProjLoc.append("No Project Position at origin point")
else:
	outProjLoc = XYZ(projPos.EastWest,projPos.NorthSouth,0).ToPoint()
	
OUT = outProjLoc, outProjBasePt, outProjSurvPt, doc.ActiveProjectLocation.Name
# ----------------------------------------
code_block = CodeBlock(x=get_project_origin_basepoint_and) { x[2]; }
python_script = Python(IN[0]=code_block)  # IronPython2
# ---------- python_script.python (1 lines) ----------
OUT = str(IN[0])
# ----------------------------------------
code_block_2 = CodeBlock { "Point("; ", "; ")"; }
split = String.Split(str=python_script, separator0=code_block_2.out0, separator1=code_block_2.out1, separator2=code_block_2.out2)
code_block_3 = CodeBlock(x=split) { x[0]; }
code_block_4 = CodeBlock(x=split) { x[1]; }
code_block_5 = CodeBlock(x=split) { x[2]; }
code_block_6 = CodeBlock(x=code_block_3, y=code_block_4, z=code_block_5)
# ---------- code_block_6.designscript (9 lines) ----------
x
+"
"
+
y
+"
"
+
z;
# ----------------------------------------
code_block_7 = CodeBlock(input=code_block_6)
# ---------- code_block_7.designscript (8 lines) ----------
familytype = FamilyType.ByName("pdeInfoBox");
familyinstance = Revit.FamilyInstance.ByFamilyType(familytype);
id = "projectSurveyPoint";
a = Revit.Elements.Element.GetParameterValueByName(familyinstance, "ID");
t1 = ((a == id ? true : false));
t4 = List.FilterByBoolMask(familyinstance, t1);
t5 = DesignScript.Dictionary.ValueAtKey(t4, "in");
Revit.Elements.Element.SetParameterByName(t5, "isValue", input);
# ----------------------------------------
code_block_8 = CodeBlock(x=code_block_7.out7)
# ---------- code_block_8.designscript (2 lines) ----------
element = ((List.IsEmpty(x) ? false : x));
Revit.Elements.Element.SetParameterByName(element, "lastUpdate", (DateTime.Now+""));
# ----------------------------------------
