# Dynamo graph script.dyn "001" (Dynamo 2.6.1.8786)

code_block = CodeBlock { "Sum area"; }
code_block_2 = CodeBlock { "OST_Rooms"; }
byName = Category.ByName(name=code_block_2)
string_from_object = FromObject(obj=byName)
python_script = Python(IN[0]=string_from_object)
# ---------- python_script.python (46 lines) ----------
#dynre*
#enzrnt
#IsolatedPickModelElements

import clr

clr.AddReference("RevitAPIUI")
from  Autodesk.Revit.UI import *

clr.AddReference("RevitServices")
import RevitServices
from RevitServices.Persistence import DocumentManager
doc = DocumentManager.Instance.CurrentDBDocument
uidoc=DocumentManager.Instance.CurrentUIApplication.ActiveUIDocument

clr.AddReference("RevitNodes")
import Revit
clr.ImportExtensions(Revit.Elements)

sel1 = uidoc.Selection
obt1 = Selection.ObjectType.Element
class CustomISelectionFilter(Selection.ISelectionFilter):
	def __init__(self, nom_categorie):
		self.nom_categorie = nom_categorie
	def AllowElement(self, e):
		if e.Category.Name == self.nom_categorie:
			return True
		else:
			return False
	def AllowReference(self, ref, point):
		return true
		
el_ref = sel1.PickObjects(obt1, CustomISelectionFilter(IN[0]), 'Pick elements of category, ' + (IN[0]) + ' Press finish to complete.')
typelist = list()
idlist = list()
for i in el_ref:
	
	try:
		typelist.append(doc.GetElement(i.ElementId))
	except:
		typelist.apped(list())
		

OUT = typelist

#dynre*
# ----------------------------------------
python_script_2 = Python(IN[0]=python_script)
# ---------- python_script_2.python (32 lines) ----------
#dynre*
#orttvs
#GetRoomArea

import clr
clr.AddReference('RevitAPI')
from Autodesk.Revit.DB import *

clr.AddReference('RevitNodes')
import Revit
clr.ImportExtensions(Revit.GeometryConversion)
clr.ImportExtensions(Revit.Elements)

clr.AddReference('RevitServices')
import RevitServices
from RevitServices.Persistence import DocumentManager
from RevitServices.Transactions import TransactionManager

doc = DocumentManager.Instance.CurrentDBDocument

#converting
elements = UnwrapElement(IN[0])
output = []

#getting
for element in elements:
	a = element.get_Parameter(BuiltInParameter.ROOM_AREA).AsDouble()
	output.append(a)
	
OUT = output

#dynre*
# ----------------------------------------
python_script_3 = Python(IN[0]=python_script_2)
# ---------- python_script_3.python (39 lines) ----------
#dynre*
#keqolr
#ConvertFromInternalValuesToMeter(SQUAREMETERS)

import clr
import sys
clr.AddReference('ProtoGeometry')
from Autodesk.DesignScript.Geometry import *

# Import DocumentManager and TransactionManager
clr.AddReference("RevitServices")
import RevitServices
from RevitServices.Persistence import DocumentManager
from RevitServices.Transactions import TransactionManager

doc = DocumentManager.Instance.CurrentDBDocument
uiapp = DocumentManager.Instance.CurrentUIApplication
app = uiapp.Application

# Import RevitAPI
clr.AddReference("RevitAPI")
import Autodesk
from Autodesk.Revit.DB import *
import System

def tolist(obj1):
	if hasattr(obj1,"__iter__"): return obj1
	else: return [obj1]
	
x = UnwrapElement(tolist(IN[0]))
output = []

for i in x :
	convertfrom = UnitUtils.ConvertFromInternalUnits(i,UnitTypeId.SquareMeters)
	output.append(convertfrom)
	
OUT = output

#dynre*
# ----------------------------------------
sum = Math.Sum(values=python_script_3)
string_from_object_2 = FromObject(obj=sum)
code_block_3 = CodeBlock { "m²"; }
isNull = Object.IsNull(obj=sum)
python_script_4 = Python(IN[0]=code_block, IN[1]=string_from_object_2, IN[2]=code_block_3, IN[3]=isNull)
# ---------- python_script_4.python (16 lines) ----------
#dynre*
#piuqdn
#TaskDialog

import clr
# Import RevitAPI
clr.AddReference("RevitAPIUI")
import Autodesk
from Autodesk.Revit.UI import TaskDialog

msgBox = TaskDialog

if IN[3] == 0: OUT = msgBox.Show(IN[0], IN[1] + IN[2])
else: OUT = 0

#dynre*
# ----------------------------------------
